# Grasshopper definition 160107_Realtime Simulator_Solar Radiation.gh (Grasshopper 0.9.76)
# plug-ins: DIVA.ForGrasshopper, Python Interpreter, HDTReference

# ---- group: grid size
number_slider = Slider(5, range=1..19)
number_slider_2 = Slider(5, range=1..19)

# ---- group: grid dimension
# Realtime Simulator
# 
# by Yan "Ryan" Zhang <ryanz@mit.edu>
# for MIT Media Lab, Changing Place Group, CityScope Project
# March.7th.2016
# Parametric Modelling
number_slider_3 = Slider(34.331, range=1..100)

# ---- group: building dimension
number_slider_4 = Slider(32.578, range=1..100)

# ---- group: building heights
number_slider_5 = Slider(0.1, range=0.1..100)
number_slider_6 = Slider(50, range=1..100)
number_slider_7 = Slider(25, range=1..100)
number_slider_8 = Slider(80, range=1..100)

# ---- group: randam seed for context
# 0, 10, 20, 50
number_slider_9 = Slider(5465, range=0..10000)

# ---- group: heightListID
# 1, 3
number_slider_10 = Slider(1, range=0..3)

# ----
# Analysis (with Central Building)
python = PythonScript()  # -> Out, A; disabled

# ---- group: glass
brep = Brep()
M = Material(Geometry=brep, Geometry_2=brep, Material="Glazing_DoublePane_LowE_65")  # -> GeometryWithMaterialAssigned, GeometryWithMaterialAssigned_2

# ---- group: ground
brep_2 = Brep()
M_2 = Material(Geometry=brep_2, Geometry_2=brep_2, Material="OutsideGround_20")  # -> GeometryWithMaterialAssigned, GeometryWithMaterialAssigned_2

# ----
unit_width = Slider(5, range=0..10)
unit_height = Slider(5, range=0..10)

# ---- group: can not be button!
toggle = BooleanToggle(False)

# ----
unit_width_2 = Slider(1.5, range=0..10)
unit_height_2 = Slider(4.2, range=0..10)

# ---- group: glass
brep_3 = Brep()
M_3 = Material(Geometry=brep_3, Geometry_2=brep_3, Material="Glazing_DoublePane_LowE_65")  # -> GeometryWithMaterialAssigned, GeometryWithMaterialAssigned_2

# ---- group: ground
brep_4 = Brep()
M_4 = Material(Geometry=brep_4, Geometry_2=brep_4, Material="OutsideGround_20")  # -> GeometryWithMaterialAssigned, GeometryWithMaterialAssigned_2

# ----
unit_width_3 = Slider(5, range=0..10)
unit_height_3 = Slider(5, range=0..10)

# ---- group: can not be button!
# Analysis (without Central Building)
toggle_2 = BooleanToggle(False)

# ----
unit_width_4 = Slider(1.5, range=0..10)
unit_height_4 = Slider(4.2, range=0..10)

merge = Merge(Data1=number_slider_5, Data2=number_slider_7, Data3=number_slider_6, Data4=number_slider_8)
recgrid = Rectangular(Plane=PlaneXY(0, 0, 0), SizeX=number_slider_3, SizeY=number_slider_3, ExtentX=number_slider, ExtentY=number_slider_2)  # -> Cells, Points
num = Number(unit_width)
num_2 = Number(unit_height)
item = ListItem(List=merge, Index=number_slider_10, Wrap=False)
num_3 = Number(unit_width_3)
num_4 = Number(unit_height_3)
end = EndPoints(Curve=recgrid.Cells)  # -> Start, End
pshift = ShiftPaths(Data=end.Start, Offset=-1)
lng = ListLength(List=pshift)
eval = Evaluate(F="int((x+1)/2)", x=lng)
subtraction = Subtraction(A=eval, B=2)
dom = ConstructDomain(DomainStart=0, DomainEnd=subtraction)
subtraction_2 = Subtraction(A=lng, B=1)
lng_2 = ListLength(List=merge)
addition = Addition(A=subtraction, B=1)
subset = SubList(List=pshift, Domain=dom, Wrap=False)  # -> List, Index
dom_2 = ConstructDomain(DomainStart=eval, DomainEnd=subtraction_2)
subtraction_3 = Subtraction(A=lng_2, B=1)
item_2 = ListItem(List=pshift, Index=addition, Wrap=True)
subset_2 = SubList(List=pshift, Domain=dom_2, Wrap=False)  # -> List, Index
dom_3 = ConstructDomain(DomainStart=0, DomainEnd=subtraction_3)
merge_2 = Merge(Data1=subset.List, Data2=subset_2.List)
lng_3 = ListLength(List=merge_2)
random = Random(Range=Domain(0, 1), Number=lng_3, Seed=number_slider_9)
graph = GraphMapper(
    random,
    x0=0,
    x1=1,
    y0=0,
    y1=1,
    container_name="Bezier",
    cpx=[0, 0.5129005909, 1, 1],
    cpy=[0, 0.00346583128, 0.3901748657, 1])
remap = RemapNumbers(Value=graph, Source=Domain(0, 1), Target=dom_3)  # -> Mapped, Clipped
nodes_offset_out = Slider(0.1, range=0..1)

# ---- group: starting pt (except centeral one)
pt = Point(merge_2)

# ---- group: centeral starting pt
pt_2 = Point(item_2)

# ----
nodes_offset_out_2 = Slider(0.1, range=0..1)
int = Integer(remap.Mapped)
xy = XYPlane(Origin=pt_2)
xy_2 = XYPlane(Origin=pt)
dom_4 = ConstructDomain(DomainStart=0, DomainEnd=Slider(0.1, range=0.1..100))
item_3 = ListItem(List=merge, Index=int, Wrap=True)
dom_5 = ConstructDomain(DomainStart=0, DomainEnd=number_slider_4)
dom_6 = ConstructDomain(DomainStart=0, DomainEnd=item_3)
dom_7 = ConstructDomain(DomainStart=0, DomainEnd=item)
box = DomainBox(Base=xy, X=dom_5, Y=dom_5, Z=dom_4)
box_2 = DomainBox(Base=xy_2, X=dom_5, Y=dom_5, Z=dom_6)
box_3 = DomainBox(Base=xy, X=dom_5, Y=dom_5, Z=dom_7)

# ---- group: center blank replacement
brep_5 = Brep(box)

# ----
swatch = ColourSwatch(SwatchColor=RGBA(191, 191, 191, 75))
swatch_2 = ColourSwatch(SwatchColor=RGBA(171, 190, 255, 150))

# ---- group: context geometry
brep_6 = Brep(box_2)

# ---- group: slab
brep_7 = Brep([brep_6, brep_5])
M_5 = Material(Geometry=brep_7, Geometry_2=brep_7, Material="GenericCeiling_80")  # -> GeometryWithMaterialAssigned, GeometryWithMaterialAssigned_2

# ---- group: node base srf
brep_8 = Brep([brep_6, brep_5])

# ----
extractbreptoporbottom = ExtractBrepTopOrBottom(brep=brep_8, bool=True)
debrep = DeconstructBrep(Brep=brep_8)  # -> Faces, Edges, Vertices
srf = Surface(reparameterize(flatten(extractbreptoporbottom)))

# ---- group: glass srf
srf_2 = Surface(reparameterize(graft(srf)))

# ----
dim = Dimensions(Surface=srf_2)  # -> UDimension, VDimension
division = Division(A=dim.VDimension, B=num_4)
division_2 = Division(A=dim.UDimension, B=num_3)
divide = DivideDomain²(Domain=srf_2, UCount=division_2, VCount=division)
subsrf = Isotrim(Surface=srf_2, Domain=divide)

# ---- group: result geo
srf_3 = Surface(reparameterize(flatten(subsrf)))

# ----
join = BrepJoin(Breps=flatten(brep_8))  # -> Breps, Closed
area = Area(Geometry=srf_3)  # -> Area, Centroid
mesh = MeshBrep(
    Brep=join.Breps,
    Settings={GridMaxCount=0, GridMinCount=16, JaggedSeams=False, MaxEdgeLength=0, MinEdgeLength=0.0001, MinTolerance=0, Refine=True, RefineAngle=0, RelativeTolerance=0.65, SimplePlanes=True, Tolerance=0})
mjoin = MeshJoin(Meshes=mesh)
meshcp = MeshClosestPoint(Point=area.Centroid, Mesh=mjoin)  # -> Point, Index, Parameter
meval = MeshEval(Mesh=mjoin, Parameter=meshcp.Parameter)  # -> Point, Normal, Colour
amp = Amplitude(Vector=meval.Normal, Amplitude=nodes_offset_out_2)

# ---- group: optional
# default: -ab 2 -ad 1000 -as 20 -ar 300 -aa 0.1
# low1: -ab 2 -ad 600 -as 12 -ar 200 -aa 0.1
# low2: -ab 2 -ad 450 -as 9 -ar 150 -aa 0.1
# low3: -ab 2 -ad 300 -as 6 -ar 100 -aa 0.1
vec = Vector(amp)

# ----
move = Move(Geometry=area.Centroid, Motion=amp)  # -> Geometry, Transform

# ---- group: testing nodes
pt_3 = Point(move.Geometry)

# ----
diva_daylight = DIVADaylightAnalysisForGH(
    ProjectName="PROJECT_NAME",
    GeometryWithRadianceMaterialReference=[M_3.GeometryWithMaterialAssigned_2, M_5.GeometryWithMaterialAssigned_2, M_4.GeometryWithMaterialAssigned_2],
    AnalysisNodes=pt_3,
    WriteOnly=False,
    RunSimulation=toggle_2,
    ProjectName_2="PROJECT_NAME",
    GeometryWithRadianceMaterialReference_2=[M_3.GeometryWithMaterialAssigned_2, M_5.GeometryWithMaterialAssigned_2, M_4.GeometryWithMaterialAssigned_2],
    AnalysisNodes_2=pt_3,
    WriteOnly_2=False,
    RunSimulation_2=toggle_2,
    Climate_Occ=0,
    Climate_RadParam="-ab 2 -ad 1000 -as 20 -ar 300 -aa 0.1",
    DF_RadParam="-ab 2 -ad 1000 -as 20 -ar 300 -aa 0.1",
    DimIrr=200,
    DirIrr=800,
    Ill_RadParam="-ab 2 -ad 1000 -as 20 -ar 300 -aa 0.1",
    Insol_CustomDates=False,
    Insol_EndDay=30,
    Insol_EndMonth=11,
    Insol_RadParam="-ab 2 -ad 1000 -as 20 -ar 300 -aa 0.1",
    Insol_StartDay=0,
    Insol_StartMonth=0,
    Insol_Vis_RadParam="-ab 2 -ad 1000 -as 20 -ar 300 -aa 0.1",
    InsolationPeriod=0,
    Irr_FC_legend_max="auto",
    Light_Operation=3,
    Lighting_Param="-W 250.0 -Set 300 -Loss 20 -Standby 0.0",
    Location="USA_MA_Boston-Logan.Intl.AP.725090_TMY3.epw",
    Lum_FC_legend_max="auto",
    MDH_Input=False,
    MinIll=300,
    OutputStates=True,
    Quality=0,
    Rhino_Include=False,
    SimulationType=0,
    SkyCond=0,
    StartDay=20,
    StartHour=12,
    StartMonth=5,
    Vis_RadParam="-ps 8 -pt .15 -pj .6 -dj 0 -ds .5 -dt .5 -dc .25 -dr 0 -dp 64 -st .85 -ab 2 -aa .25 -ar 16 -ad 512 -as 128 -lr 4 -lw .05 -av 0 0 0",
    X_Resolution=600,
    Y_Resolution=400)  # -> OutputMessage, MetricSolarIrradiation, OutputMessage_2, MetricSolarIrradiation_2

# ---- group: result with ground
num_5 = Number(diva_daylight.MetricSolarIrradiation_2)

# ---- group: Internalise to record the result
num_6 = Number(diva_daylight.MetricSolarIrradiation_2)

# ----
bnd = Bounds(Numbers=num_5)

# ---- group: center building block geometry
brep_9 = Brep(box_3)

# ---- group: slab
brep_10 = Brep([brep_6, brep_9])
M_6 = Material(Geometry=brep_10, Geometry_2=brep_10, Material="GenericCeiling_80")  # -> GeometryWithMaterialAssigned, GeometryWithMaterialAssigned_2

# ---- group: node base srf
brep_11 = Brep([brep_6, brep_9])

# ----
extractbreptoporbottom_2 = ExtractBrepTopOrBottom(brep=brep_11, bool=True)
debrep_2 = DeconstructBrep(Brep=brep_11)  # -> Faces, Edges, Vertices
srf_4 = Surface(reparameterize(flatten(extractbreptoporbottom_2)))

# ---- group: glass srf
srf_5 = Surface(reparameterize(graft(srf_4)))

# ----
dim_2 = Dimensions(Surface=srf_5)  # -> UDimension, VDimension
area_2 = Area(Geometry=srf_4)  # -> Area, Centroid
division_3 = Division(A=dim_2.VDimension, B=num_2)
division_4 = Division(A=dim_2.UDimension, B=num)
divide_2 = DivideDomain²(Domain=srf_5, UCount=division_4, VCount=division_3)
pdecon = Deconstruct(Point=area_2.Centroid)  # -> XComponent, YComponent, ZComponent
subsrf_2 = Isotrim(Surface=srf_5, Domain=divide_2)

# ---- group: input building height
num_7 = Number(pdecon.ZComponent)

# ---- group: result geo
srf_6 = Surface(reparameterize(flatten(subsrf_2)))

# ----
join_2 = BrepJoin(Breps=flatten(brep_11))  # -> Breps, Closed
area_3 = Area(Geometry=srf_6)  # -> Area, Centroid
mesh_2 = MeshBrep(
    Brep=join_2.Breps,
    Settings={GridMaxCount=0, GridMinCount=16, JaggedSeams=False, MaxEdgeLength=0, MinEdgeLength=0.0001, MinTolerance=0, Refine=True, RefineAngle=0, RelativeTolerance=0.65, SimplePlanes=True, Tolerance=0})
mjoin_2 = MeshJoin(Meshes=mesh_2)
meshcp_2 = MeshClosestPoint(Point=area_3.Centroid, Mesh=mjoin_2)  # -> Point, Index, Parameter
meval_2 = MeshEval(Mesh=mjoin_2, Parameter=meshcp_2.Parameter)  # -> Point, Normal, Colour
amp_2 = Amplitude(Vector=meval_2.Normal, Amplitude=nodes_offset_out)

# ---- group: optional
# default: -ab 2 -ad 1000 -as 20 -ar 300 -aa 0.1
# low1: -ab 2 -ad 600 -as 12 -ar 200 -aa 0.1
# low2: -ab 2 -ad 450 -as 9 -ar 150 -aa 0.1
# low3: -ab 2 -ad 300 -as 6 -ar 100 -aa 0.1
vec_2 = Vector(amp_2)

# ----
move_2 = Move(Geometry=area_3.Centroid, Motion=amp_2)  # -> Geometry, Transform

# ---- group: testing nodes
pt_4 = Point(move_2.Geometry)

# ----
diva_daylight_2 = DIVADaylightAnalysisForGH(
    ProjectName="PROJECT_NAME",
    GeometryWithRadianceMaterialReference=[M.GeometryWithMaterialAssigned_2, M_6.GeometryWithMaterialAssigned_2, M_2.GeometryWithMaterialAssigned_2],
    AnalysisNodes=pt_4,
    WriteOnly=False,
    RunSimulation=toggle,
    ProjectName_2="PROJECT_NAME",
    GeometryWithRadianceMaterialReference_2=[M.GeometryWithMaterialAssigned_2, M_6.GeometryWithMaterialAssigned_2, M_2.GeometryWithMaterialAssigned_2],
    AnalysisNodes_2=pt_4,
    WriteOnly_2=False,
    RunSimulation_2=toggle,
    Climate_Occ=0,
    Climate_RadParam="-ab 2 -ad 1000 -as 20 -ar 300 -aa 0.1",
    DF_RadParam="-ab 2 -ad 1000 -as 20 -ar 300 -aa 0.1",
    DimIrr=200,
    DirIrr=800,
    Ill_RadParam="-ab 2 -ad 1000 -as 20 -ar 300 -aa 0.1",
    Insol_CustomDates=False,
    Insol_EndDay=30,
    Insol_EndMonth=11,
    Insol_RadParam="-ab 2 -ad 1000 -as 20 -ar 300 -aa 0.1",
    Insol_StartDay=0,
    Insol_StartMonth=0,
    Insol_Vis_RadParam="-ab 2 -ad 1000 -as 20 -ar 300 -aa 0.1",
    InsolationPeriod=0,
    Irr_FC_legend_max="auto",
    Light_Operation=3,
    Lighting_Param="-W 250.0 -Set 300 -Loss 20 -Standby 0.0",
    Location="USA_MA_Boston-Logan.Intl.AP.725090_TMY3.epw",
    Lum_FC_legend_max="auto",
    MDH_Input=False,
    MinIll=300,
    OutputStates=True,
    Quality=0,
    Rhino_Include=False,
    SimulationType=0,
    SkyCond=0,
    StartDay=20,
    StartHour=12,
    StartMonth=5,
    Vis_RadParam="-ps 8 -pt .15 -pj .6 -dj 0 -ds .5 -dt .5 -dc .25 -dr 0 -dp 64 -st .85 -ab 2 -aa .25 -ar 16 -ad 512 -as 128 -lr 4 -lw .05 -av 0 0 0",
    X_Resolution=600,
    Y_Resolution=400)  # -> OutputMessage, MetricSolarIrradiation, OutputMessage_2, MetricSolarIrradiation_2

# ---- group: result with ground
num_8 = Number(diva_daylight_2.MetricSolarIrradiation_2)

# ---- group: Internalise to record the result
num_9 = Number(diva_daylight_2.MetricSolarIrradiation_2)

# ----
bnd_2 = Bounds(Numbers=num_8)
remap_2 = RemapNumbers(Value=num_8, Source=bnd_2, Target=Domain(0, 1))  # -> Mapped, Clipped
remap_3 = RemapNumbers(Value=num_5, Source=bnd_2, Target=Domain(0, 1))  # -> Mapped, Clipped
gradient = Gradient(
    LowerLimit=0,
    UpperLimit=1,
    Parameter=remap_2.Mapped,
    stops=[0: RGB(0, 128, 0), 0.5: RGB(255, 255, 0), 1: RGB(255, 0, 0)])

# ---- group: BAKE RESULT HATCH
srf_7 = Surface(srf_6)
col = Colour(gradient)
edges = BrepEdges(Brep=srf_7)  # -> Naked, Interior, NonManifold
join_3 = JoinCurves(Curves=edges.Naked, Preserve=False)
graft = GraftTree(Tree=col, IncludeEmptyLists=True, IncludeNullItems=True)
pshift_2 = ShiftPaths(Data=join_3, Offset=-1)
createatts = CreateAttributes(LayerName="result hatch 01", Color=graft, enableFullPath=False)
createhatch = CreateHatch(Bake=Toggle(False), Curves=pshift_2, HatchPatternName="Solid", HatchScale=1, HatchRotation=0, Attributes=createatts)

# ----
gradient_2 = Gradient(
    LowerLimit=0,
    UpperLimit=1,
    Parameter=remap_3.Mapped,
    stops=[0: RGB(0, 128, 0), 0.5: RGB(255, 255, 0), 1: RGB(255, 0, 0)])

# ---- group: BAKE RESULT HATCH
srf_8 = Surface(srf_3)
col_2 = Colour(gradient_2)
edges_2 = BrepEdges(Brep=srf_8)  # -> Naked, Interior, NonManifold
join_4 = JoinCurves(Curves=edges_2.Naked, Preserve=False)
graft_2 = GraftTree(Tree=col_2, IncludeEmptyLists=True, IncludeNullItems=True)
pshift_3 = ShiftPaths(Data=join_4, Offset=-1)
createatts_2 = CreateAttributes(LayerName="result hatch 01", Color=graft_2, enableFullPath=False)
createhatch_2 = CreateHatch(Bake=Toggle(False), Curves=pshift_3, HatchPatternName="Solid", HatchScale=1, HatchRotation=0, Attributes=createatts_2)

# ---- group: result
preview = CustomPreview(Geometry=srf_6, Shader=gradient)

preview_2 = CustomPreview(Geometry=srf_3, Shader=gradient_2)

# ----
removebreptoporbottom = RemoveBrepTopOrBottom(brep=brep_6, bool=True)
preview_3 = CustomPreview(Geometry=removebreptoporbottom, Shader=swatch)
removebreptoporbottom_2 = RemoveBrepTopOrBottom(brep=brep_9, bool=True)
preview_4 = CustomPreview(Geometry=removebreptoporbottom_2, Shader=swatch_2)
# Analysis (difference)
subtraction_4 = Subtraction(A=num_8, B=num_5)

# ---- group: input building height
# Data Export
panel = Panel(num_7)

# ----
bnd_3 = Bounds(Numbers=subtraction_4)

# ---- group: result difference
num_10 = Number(subtraction_4)

# ----
remap_4 = RemapNumbers(Value=num_10, Source=bnd_3, Target=Domain(0, 1))  # -> Mapped, Clipped
neg = Negative(Value=Slider(1000, range=0..1000))
X = UnitX(Factor=neg)
X_2 = UnitX(Factor=neg)
move_3 = Move(Geometry=brep_9, Motion=X)  # -> Geometry, Transform
move_4 = Move(Geometry=brep_6, Motion=X_2)  # -> Geometry, Transform
num_11 = Number(item)
int_2 = Integer(number_slider_9)

# ---- group: output node reads
panel_2 = Panel(num_8)

# ----
preview_5 = CustomPreview(Geometry=move_3.Geometry, Shader=swatch_2)
gradient_3 = Gradient(
    LowerLimit=0,
    UpperLimit=1,
    Parameter=remap_4.Mapped,
    stops=[0: RGB(0, 128, 0), 0.5: RGB(255, 255, 0), 1: RGB(255, 0, 0)])
txt = Text(int_2)
txt_2 = Text(num_11)
X_3 = UnitX(Factor=Slider(1000, range=0..1000))
preview_6 = CustomPreview(Geometry=move_4.Geometry, Shader=swatch)
move_5 = Move(Geometry=srf_6, Motion=X_3)  # -> Geometry, Transform

# ---- group: node reads difference
panel_3 = Panel(num_10)

# ----
merge_3 = Merge(
    Data1="[start]central building height",
    Data2=txt_2,
    Data3="[end]central building height",
    Data4="[start]random seed number",
    Data5=txt,
    Data6="[end]random seed number",
    Data7="[start]input building height",
    Data8=panel,
    Data9="[end]input building height",
    Data10="[start]output node reads",
    Data11=panel_2,
    Data12="[end]output node reads",
    Data13="[start]node reads difference",
    Data14=panel_3,
    Data15="[end]node reads difference")

# ---- group: result
preview_7 = CustomPreview(Geometry=move_5.Geometry, Shader=gradient_3)

# ----
number_slider_11 = Slider(1000, range=0..1000)
X_4 = UnitX(Factor=number_slider_11)
X_5 = UnitX(Factor=number_slider_11)

# ---- group: data to export
panel_4 = Panel(merge_3)

# ----
move_6 = Move(Geometry=removebreptoporbottom_2, Motion=X_4)  # -> Geometry, Transform
move_7 = Move(Geometry=removebreptoporbottom, Motion=X_5)  # -> Geometry, Transform
preview_8 = CustomPreview(Geometry=move_6.Geometry, Shader=swatch_2)
preview_9 = CustomPreview(Geometry=move_7.Geometry, Shader=swatch)
panel_5 = Panel("C:\Users\RYAN\Dropbox (MIT)\01_Work\Resources\test.txt")
panel_6 = Panel("C:\Users\RYAN\Dropbox (MIT)\01_Work\MAS\Realtime Simulator\Data\160110_H25_R")
int_3 = Integer(number_slider_9)
toggle_append = BooleanToggle(False)
toggle_activate = BooleanToggle(True)
txt_3 = Text(int_3)
merge_4 = Merge(Data1=panel_6, Data2=txt_3, Data3=".txt")
join_5 = TextJoin(Text=merge_4)
panel_7 = Panel(join_5)

# ---- group: write txt file
vb = VBScript(filePath=panel_7, data=panel_4, append=toggle_append, activate=toggle_activate)  # -> out, A; inputs data: list
# ---------- vb: VB ----------
    'Code by Victor Leung @ www.dreamationworks.com
    If activate Then

      Dim i As Integer
      Dim aryText(4) As String

      aryText(0) = "Mary WriteLine"
      aryText(1) = "Had"
      aryText(2) = "Another"
      aryText(3) = "Little"
      aryText(4) = "One"

      ' the data is appended to the file. If file doesnt exist, a new file is created
      Dim objWriter As New System.IO.StreamWriter(filePath, append)

      For i = 0 To data.Count - 1
        objWriter.WriteLine(data(i))
      Next

      objWriter.Close()

    End If

    If clearFile Then
      Dim objWriter As New System.IO.StreamWriter(filePath, False)
      objWriter.Close()
    End If
# ---------- end vb ----------

# ==== cluster ExtractBrepTopOrBottom
brep = ClusterInput()
bool = ClusterInput()
brep_2 = Brep(brep)
bool_2 = Boolean(bool)
num = Number(bool_2)
debrep = DeconstructBrep(Brep=brep_2)  # -> Faces, Edges, Vertices
subtraction = Subtraction(A=num, B=0.5)
multiplication = Multiplication(A=subtraction, B=2)
Z = UnitZ(Factor=multiplication)
area = Area(Geometry=debrep.Faces)  # -> Area, Centroid
srf_cp = SurfaceClosestPoint(Point=area.Centroid, Surface=debrep.Faces)  # -> Point, UVPoint, Distance
evalsrf = EvaluateSurface(Surface=debrep.Faces, Point=srf_cp.UVPoint)  # -> Point, Normal, Frame
angle = Angle(VectorA=evalsrf.Normal, VectorB=Z)  # -> Angle, Reflex
equals = Equality(FirstNumber=angle.Angle, SecondNumber=0)  # -> Equality, Inequality
dispatch = Dispatch(List=debrep.Faces, DispatchPattern=equals.Equality)  # -> ListA, ListB
srf = Surface(dispatch.ListA)
srf_2 = ClusterOutput(srf)

# ==== cluster RemoveBrepTopOrBottom
brep = ClusterInput()
bool = ClusterInput()
brep_2 = Brep(brep)
bool_2 = Boolean(bool)
num = Number(bool_2)
debrep = DeconstructBrep(Brep=brep_2)  # -> Faces, Edges, Vertices
subtraction = Subtraction(A=num, B=0.5)
multiplication = Multiplication(A=subtraction, B=2)
Z = UnitZ(Factor=multiplication)
area = Area(Geometry=debrep.Faces)  # -> Area, Centroid
srf_cp = SurfaceClosestPoint(Point=area.Centroid, Surface=debrep.Faces)  # -> Point, UVPoint, Distance
evalsrf = EvaluateSurface(Surface=debrep.Faces, Point=srf_cp.UVPoint)  # -> Point, Normal, Frame
angle = Angle(VectorA=evalsrf.Normal, VectorB=Z)  # -> Angle, Reflex
equals = Equality(FirstNumber=angle.Angle, SecondNumber=0)  # -> Equality, Inequality
dispatch = Dispatch(List=debrep.Faces, DispatchPattern=equals.Inequality)  # -> ListA, ListB
srf = Surface(dispatch.ListA)
join = BrepJoin(Breps=srf)  # -> Breps, Closed
pshift = ShiftPaths(Data=join.Breps, Offset=-1)
brep_3 = Brep(pshift)
brep_4 = ClusterOutput(brep_3)
