# Grasshopper definition 160114_Realtime Simulator_Solar Radiation.gh (Grasshopper 0.9.76)
# plug-ins: DIVA.ForGrasshopper, Python Interpreter, HDTReference

# ---- group: grid size
number_slider = Slider(5, range=1..19)
number_slider_2 = Slider(5, range=1..19)

# ---- group: grid dimension
# Realtime Simulator
# 
# by Yan "Ryan" Zhang <ryanz@mit.edu>
# for MIT Media Lab, Changing Place Group, CityScope Project
# March.7th.2016
# Parametric Modelling
number_slider_3 = Slider(34.331, range=1..100)

# ---- group: building dimension
number_slider_4 = Slider(32.578, range=1..100)

# ---- group: building heights
number_slider_5 = Slider(0.1, range=0.1..100)
number_slider_6 = Slider(50, range=1..100)
number_slider_7 = Slider(25, range=1..100)
number_slider_8 = Slider(80, range=1..100)

# ---- group: heightListID
# 1, 3
number_slider_9 = Slider(1, range=0..3)

# ---- group: randam seed for context
# 0, 10, 20, 50
number_slider_10 = Slider(15000, range=10000..15000)

# ----
number_slider_11 = Slider(5465, range=0..5465)  # disabled
# data1: 0 to 5465
# data2: 1 to 4500
number_slider_12 = Slider(4500, range=1..4500)  # disabled
# Analysis (with Central Building)
python = PythonScript()  # -> Out, A; disabled
panel = Panel("PROJECT_NAME")  # disabled

# ---- group: glass
brep = Brep()  # disabled
M = Material(Geometry=brep, Geometry_2=brep, Material="GenericCeiling_80")  # -> GeometryWithMaterialAssigned, GeometryWithMaterialAssigned_2; disabled

# ---- group: ground
brep_2 = Brep()  # disabled
M_2 = Material(Geometry=brep_2, Geometry_2=brep_2, Material="GenericCeiling_80")  # -> GeometryWithMaterialAssigned, GeometryWithMaterialAssigned_2; disabled

# ----
unit_width = Slider(5, range=0..10)
unit_height = Slider(5, range=0..10)

# ---- group: can not be button!
toggle = BooleanToggle(False)  # disabled

# ----
unit_width_2 = Slider(1.5, range=0..10)  # disabled
unit_height_2 = Slider(4.2, range=0..10)  # disabled

panel_2 = Panel("PROJECT_NAME")  # disabled

# ---- group: glass
brep_3 = Brep()  # disabled
M_3 = Material(Geometry=brep_3, Geometry_2=brep_3, Material="GenericCeiling_80")  # -> GeometryWithMaterialAssigned, GeometryWithMaterialAssigned_2; disabled

# ---- group: ground
brep_4 = Brep()  # disabled
M_4 = Material(Geometry=brep_4, Geometry_2=brep_4, Material="GenericCeiling_80")  # -> GeometryWithMaterialAssigned, GeometryWithMaterialAssigned_2; disabled

# ----
unit_width_3 = Slider(5, range=0..10)  # disabled
unit_height_3 = Slider(5, range=0..10)  # disabled

# ---- group: can not be button!
# Analysis (without Central Building)
toggle_2 = BooleanToggle(False)  # disabled

# ----
unit_width_4 = Slider(1.5, range=0..10)  # disabled
unit_height_4 = Slider(4.2, range=0..10)  # disabled

merge = Merge(Data1=number_slider_5, Data2=number_slider_7, Data3=number_slider_6, Data4=number_slider_8)
int = Integer(number_slider_9)
int_2 = Integer(number_slider_10)
recgrid = Rectangular(Plane=PlaneXY(0, 0, 0), SizeX=number_slider_3, SizeY=number_slider_3, ExtentX=number_slider, ExtentY=number_slider_2)  # -> Cells, Points
num = Number(unit_width)
num_2 = Number(unit_height)
item = ListItem(List=merge, Index=int, Wrap=False)
num_3 = Number(unit_width_3)  # disabled
num_4 = Number(unit_height_3)  # disabled
end = EndPoints(Curve=recgrid.Cells)  # -> Start, End
pshift = ShiftPaths(Data=end.Start, Offset=-1)
lng = ListLength(List=pshift)
eval = Evaluate(F="int((x+1)/2)", x=lng)
subtraction = Subtraction(A=eval, B=2)
dom = ConstructDomain(DomainStart=0, DomainEnd=subtraction)
subtraction_2 = Subtraction(A=lng, B=1)
lng_2 = ListLength(List=merge)
addition = Addition(A=subtraction, B=1)
subset = SubList(List=pshift, Domain=dom, Wrap=False)  # -> List, Index
dom_2 = ConstructDomain(DomainStart=eval, DomainEnd=subtraction_2)
subtraction_3 = Subtraction(A=lng_2, B=1)
item_2 = ListItem(List=pshift, Index=addition, Wrap=True)
subset_2 = SubList(List=pshift, Domain=dom_2, Wrap=False)  # -> List, Index
dom_3 = ConstructDomain(DomainStart=0, DomainEnd=subtraction_3)
number_slider_13 = Slider(0.1, range=0.1..100)  # disabled
merge_2 = Merge(Data1=subset.List, Data2=subset_2.List)
lng_3 = ListLength(List=merge_2)
random = Random(Range=Domain(0, 1), Number=lng_3, Seed=int_2)
graph = GraphMapper(
    random,
    x0=0,
    x1=1,
    y0=0,
    y1=1,
    container_name="Bezier",
    cpx=[0, 0.5129005909, 1, 1],
    cpy=[0, 0.00346583128, 0.3901748657, 1])
remap = RemapNumbers(Value=graph, Source=Domain(0, 1), Target=dom_3)  # -> Mapped, Clipped
nodes_offset_out = Slider(0.1, range=0..1)

# ---- group: starting pt (except centeral one)
pt = Point(merge_2)

# ---- group: centeral starting pt
pt_2 = Point(item_2)

# ----
nodes_offset_out_2 = Slider(0.1, range=0..1)  # disabled
int_3 = Integer(remap.Mapped)
xy = XYPlane(Origin=pt_2)
xy_2 = XYPlane(Origin=pt)
dom_4 = ConstructDomain(DomainStart=0, DomainEnd=number_slider_13)  # disabled
item_3 = ListItem(List=merge, Index=int_3, Wrap=True)
dom_5 = ConstructDomain(DomainStart=0, DomainEnd=number_slider_4)
dom_6 = ConstructDomain(DomainStart=0, DomainEnd=item_3)
dom_7 = ConstructDomain(DomainStart=0, DomainEnd=item)
box = DomainBox(Base=xy, X=dom_5, Y=dom_5, Z=dom_4)  # disabled
box_2 = DomainBox(Base=xy_2, X=dom_5, Y=dom_5, Z=dom_6)
box_3 = DomainBox(Base=xy, X=dom_5, Y=dom_5, Z=dom_7)

# ---- group: center blank replacement
brep_5 = Brep(box)  # disabled

# ----
swatch = ColourSwatch(SwatchColor=RGBA(191, 191, 191, 75))  # disabled
swatch_2 = ColourSwatch(SwatchColor=RGBA(171, 190, 255, 150))  # disabled

# ---- group: context geometry
brep_6 = Brep(box_2)

# ---- group: slab
brep_7 = Brep([brep_6, brep_5])  # disabled
M_5 = Material(Geometry=brep_7, Geometry_2=brep_7, Material="GenericCeiling_80")  # -> GeometryWithMaterialAssigned, GeometryWithMaterialAssigned_2; disabled

# ---- group: node base srf
brep_8 = Brep([brep_6, brep_5])  # disabled

# ----
extractbreptoporbottom = ExtractBrepTopOrBottom(brep=brep_8, bool=True)  # disabled
debrep = DeconstructBrep(Brep=brep_8)  # -> Faces, Edges, Vertices; disabled
srf = Surface(reparameterize(flatten(extractbreptoporbottom)))  # disabled

# ---- group: glass srf
srf_2 = Surface(reparameterize(graft(srf)))  # disabled

# ----
dim = Dimensions(Surface=srf_2)  # -> UDimension, VDimension; disabled
division = Division(A=dim.VDimension, B=num_4)  # disabled
division_2 = Division(A=dim.UDimension, B=num_3)  # disabled
divide = DivideDomain²(Domain=srf_2, UCount=division_2, VCount=division)  # disabled
subsrf = Isotrim(Surface=srf_2, Domain=divide)  # disabled

# ---- group: result geo
srf_3 = Surface(reparameterize(flatten(subsrf)))  # disabled

# ----
join = BrepJoin(Breps=flatten(brep_8))  # -> Breps, Closed; disabled
area = Area(Geometry=srf_3)  # -> Area, Centroid; disabled
mesh = MeshBrep(
    Brep=join.Breps,
    Settings={GridMaxCount=0, GridMinCount=16, JaggedSeams=False, MaxEdgeLength=0, MinEdgeLength=0.0001, MinTolerance=0, Refine=True, RefineAngle=0, RelativeTolerance=0.65, SimplePlanes=True, Tolerance=0})  # disabled
mjoin = MeshJoin(Meshes=mesh)  # disabled
meshcp = MeshClosestPoint(Point=area.Centroid, Mesh=mjoin)  # -> Point, Index, Parameter; disabled
meval = MeshEval(Mesh=mjoin, Parameter=meshcp.Parameter)  # -> Point, Normal, Colour; disabled
amp = Amplitude(Vector=meval.Normal, Amplitude=nodes_offset_out_2)  # disabled

# ---- group: optional
# default: -ab 2 -ad 1000 -as 20 -ar 300 -aa 0.1
# low1: -ab 2 -ad 600 -as 12 -ar 200 -aa 0.1
# low2: -ab 2 -ad 450 -as 9 -ar 150 -aa 0.1
# low3: -ab 2 -ad 300 -as 6 -ar 100 -aa 0.1
vec = Vector(amp)  # disabled

# ----
move = Move(Geometry=area.Centroid, Motion=amp)  # -> Geometry, Transform; disabled

# ---- group: testing nodes
pt_3 = Point(move.Geometry)  # disabled

# ----
diva_daylight = DIVADaylightAnalysisForGH(
    ProjectName=panel_2,
    GeometryWithRadianceMaterialReference=[M_3.GeometryWithMaterialAssigned_2, M_5.GeometryWithMaterialAssigned_2, M_4.GeometryWithMaterialAssigned_2],
    AnalysisNodes=pt_3,
    WriteOnly=False,
    RunSimulation=toggle_2,
    ProjectName_2=panel_2,
    GeometryWithRadianceMaterialReference_2=[M_3.GeometryWithMaterialAssigned_2, M_5.GeometryWithMaterialAssigned_2, M_4.GeometryWithMaterialAssigned_2],
    AnalysisNodes_2=pt_3,
    WriteOnly_2=False,
    RunSimulation_2=toggle_2,
    Climate_Occ=0,
    Climate_RadParam="-ab 2 -ad 1000 -as 20 -ar 300 -aa 0.1",
    DF_RadParam="-ab 2 -ad 1000 -as 20 -ar 300 -aa 0.1",
    DimIrr=200,
    DirIrr=800,
    Ill_RadParam="-ab 2 -ad 1000 -as 20 -ar 300 -aa 0.1",
    Insol_CustomDates=False,
    Insol_EndDay=30,
    Insol_EndMonth=11,
    Insol_RadParam="-ab 2 -ad 1000 -as 20 -ar 300 -aa 0.1",
    Insol_StartDay=0,
    Insol_StartMonth=0,
    Insol_Vis_RadParam="-ab 2 -ad 1000 -as 20 -ar 300 -aa 0.1",
    InsolationPeriod=0,
    Irr_FC_legend_max="auto",
    Light_Operation=3,
    Lighting_Param="-W 250.0 -Set 300 -Loss 20 -Standby 0.0",
    Location="USA_MA_Boston-Logan.Intl.AP.725090_TMY3.epw",
    Lum_FC_legend_max="auto",
    MDH_Input=False,
    MinIll=300,
    OutputStates=True,
    Quality=0,
    Rhino_Include=False,
    SimulationType=0,
    SkyCond=0,
    StartDay=20,
    StartHour=12,
    StartMonth=5,
    Vis_RadParam="-ps 8 -pt .15 -pj .6 -dj 0 -ds .5 -dt .5 -dc .25 -dr 0 -dp 64 -st .85 -ab 2 -aa .25 -ar 16 -ad 512 -as 128 -lr 4 -lw .05 -av 0 0 0",
    X_Resolution=600,
    Y_Resolution=400)  # -> OutputMessage, MetricSolarIrradiation, OutputMessage_2, MetricSolarIrradiation_2; disabled

# ---- group: result with ground
num_5 = Number(diva_daylight.MetricSolarIrradiation_2)  # disabled

# ---- group: Internalise to record the result
num_6 = Number(diva_daylight.MetricSolarIrradiation_2)  # disabled

# ----
bnd = Bounds(Numbers=num_5)  # disabled

# ---- group: center building block geometry
brep_9 = Brep(box_3)

# ---- group: slab
brep_10 = Brep([brep_6, brep_9])  # disabled
M_6 = Material(Geometry=brep_10, Geometry_2=brep_10, Material="GenericCeiling_80")  # -> GeometryWithMaterialAssigned, GeometryWithMaterialAssigned_2; disabled

# ---- group: node base srf
brep_11 = Brep([brep_6, brep_9])

# ----
extractbreptoporbottom_2 = ExtractBrepTopOrBottom(brep=brep_11, bool=True)
debrep_2 = DeconstructBrep(Brep=brep_11)  # -> Faces, Edges, Vertices; disabled
srf_4 = Surface(reparameterize(flatten(extractbreptoporbottom_2)))

# ---- group: glass srf
srf_5 = Surface(reparameterize(graft(srf_4)))

# ----
dim_2 = Dimensions(Surface=srf_5)  # -> UDimension, VDimension
area_2 = Area(Geometry=srf_4)  # -> Area, Centroid; disabled
division_3 = Division(A=dim_2.VDimension, B=num_2)
division_4 = Division(A=dim_2.UDimension, B=num)
divide_2 = DivideDomain²(Domain=srf_5, UCount=division_4, VCount=division_3)
pdecon = Deconstruct(Point=area_2.Centroid)  # -> XComponent, YComponent, ZComponent; disabled
subsrf_2 = Isotrim(Surface=srf_5, Domain=divide_2)

# ---- group: input building height
num_7 = Number(pdecon.ZComponent)  # disabled

# ---- group: result geo
srf_6 = Surface(reparameterize(flatten(subsrf_2)))

# ----
join_2 = BrepJoin(Breps=flatten(brep_11))  # -> Breps, Closed
area_3 = Area(Geometry=srf_6)  # -> Area, Centroid
mesh_2 = MeshBrep(
    Brep=join_2.Breps,
    Settings={GridMaxCount=0, GridMinCount=16, JaggedSeams=False, MaxEdgeLength=0, MinEdgeLength=0.0001, MinTolerance=0, Refine=True, RefineAngle=0, RelativeTolerance=0.65, SimplePlanes=True, Tolerance=0})
mjoin_2 = MeshJoin(Meshes=mesh_2)
meshcp_2 = MeshClosestPoint(Point=area_3.Centroid, Mesh=mjoin_2)  # -> Point, Index, Parameter
meval_2 = MeshEval(Mesh=mjoin_2, Parameter=meshcp_2.Parameter)  # -> Point, Normal, Colour
amp_2 = Amplitude(Vector=meval_2.Normal, Amplitude=nodes_offset_out)

# ---- group: optional
# default: -ab 2 -ad 1000 -as 20 -ar 300 -aa 0.1
# low1: -ab 2 -ad 600 -as 12 -ar 200 -aa 0.1
# low2: -ab 2 -ad 450 -as 9 -ar 150 -aa 0.1
# low3: -ab 2 -ad 300 -as 6 -ar 100 -aa 0.1
vec_2 = Vector(amp_2)  # disabled

# ----
move_2 = Move(Geometry=area_3.Centroid, Motion=amp_2)  # -> Geometry, Transform

# ---- group: testing nodes
pt_4 = Point(move_2.Geometry)

# ----
diva_daylight_2 = DIVADaylightAnalysisForGH(
    ProjectName=panel,
    GeometryWithRadianceMaterialReference=[M.GeometryWithMaterialAssigned_2, M_6.GeometryWithMaterialAssigned_2, M_2.GeometryWithMaterialAssigned_2],
    AnalysisNodes=pt_4,
    WriteOnly=False,
    RunSimulation=toggle,
    ProjectName_2=panel,
    GeometryWithRadianceMaterialReference_2=[M.GeometryWithMaterialAssigned_2, M_6.GeometryWithMaterialAssigned_2, M_2.GeometryWithMaterialAssigned_2],
    AnalysisNodes_2=pt_4,
    WriteOnly_2=False,
    RunSimulation_2=toggle,
    Climate_Occ=0,
    Climate_RadParam="-ab 2 -ad 1000 -as 20 -ar 300 -aa 0.1",
    DF_RadParam="-ab 2 -ad 1000 -as 20 -ar 300 -aa 0.1",
    DimIrr=200,
    DirIrr=800,
    Ill_RadParam="-ab 2 -ad 1000 -as 20 -ar 300 -aa 0.1",
    Insol_CustomDates=False,
    Insol_EndDay=30,
    Insol_EndMonth=11,
    Insol_RadParam="-ab 2 -ad 1000 -as 20 -ar 300 -aa 0.1",
    Insol_StartDay=0,
    Insol_StartMonth=0,
    Insol_Vis_RadParam="-ab 2 -ad 1000 -as 20 -ar 300 -aa 0.1",
    InsolationPeriod=0,
    Irr_FC_legend_max="auto",
    Light_Operation=3,
    Lighting_Param="-W 250.0 -Set 300 -Loss 20 -Standby 0.0",
    Location="USA_MA_Boston-Logan.Intl.AP.725090_TMY3.epw",
    Lum_FC_legend_max="auto",
    MDH_Input=False,
    MinIll=300,
    OutputStates=True,
    Quality=0,
    Rhino_Include=False,
    SimulationType=0,
    SkyCond=0,
    StartDay=20,
    StartHour=12,
    StartMonth=5,
    Vis_RadParam="-ps 8 -pt .15 -pj .6 -dj 0 -ds .5 -dt .5 -dc .25 -dr 0 -dp 64 -st .85 -ab 2 -aa .25 -ar 16 -ad 512 -as 128 -lr 4 -lw .05 -av 0 0 0",
    X_Resolution=600,
    Y_Resolution=400)  # -> OutputMessage, MetricSolarIrradiation, OutputMessage_2, MetricSolarIrradiation_2; disabled

# ---- group: result with ground
num_8 = Number(diva_daylight_2.MetricSolarIrradiation_2)  # disabled

# ---- group: Internalise to record the result
num_9 = Number(diva_daylight_2.MetricSolarIrradiation_2)  # disabled

# ----
bnd_2 = Bounds(Numbers=num_8)  # disabled
remap_2 = RemapNumbers(Value=num_8, Source=bnd_2, Target=Domain(0, 1))  # -> Mapped, Clipped; disabled
remap_3 = RemapNumbers(Value=num_5, Source=bnd_2, Target=Domain(0, 1))  # -> Mapped, Clipped; disabled
gradient = Gradient(
    LowerLimit=0,
    UpperLimit=1,
    Parameter=remap_2.Mapped,
    stops=[0: RGB(0, 128, 0), 0.5: RGB(255, 255, 0), 1: RGB(255, 0, 0)])  # disabled

# ---- group: BAKE RESULT HATCH
toggle_3 = BooleanToggle(False)  # disabled
srf_7 = Surface(srf_6)  # disabled
col = Colour(gradient)  # disabled
panel_3 = Panel("result hatch 01")  # disabled
edges = BrepEdges(Brep=srf_7)  # -> Naked, Interior, NonManifold; disabled
join_3 = JoinCurves(Curves=edges.Naked, Preserve=False)  # disabled
graft = GraftTree(Tree=col, IncludeEmptyLists=True, IncludeNullItems=True)  # disabled
pshift_2 = ShiftPaths(Data=join_3, Offset=-1)  # disabled
createatts = CreateAttributes(LayerName=panel_3, Color=graft, enableFullPath=False)  # disabled
createhatch = CreateHatch(Bake=toggle_3, Curves=pshift_2, HatchPatternName="Solid", HatchScale=1, HatchRotation=0, Attributes=createatts)  # disabled

# ----
gradient_2 = Gradient(
    LowerLimit=0,
    UpperLimit=1,
    Parameter=remap_3.Mapped,
    stops=[0: RGB(0, 128, 0), 0.5: RGB(255, 255, 0), 1: RGB(255, 0, 0)])  # disabled

# ---- group: BAKE RESULT HATCH
toggle_4 = BooleanToggle(False)  # disabled
srf_8 = Surface(srf_3)  # disabled
col_2 = Colour(gradient_2)  # disabled
panel_4 = Panel("result hatch 01")  # disabled
edges_2 = BrepEdges(Brep=srf_8)  # -> Naked, Interior, NonManifold; disabled
join_4 = JoinCurves(Curves=edges_2.Naked, Preserve=False)  # disabled
graft_2 = GraftTree(Tree=col_2, IncludeEmptyLists=True, IncludeNullItems=True)  # disabled
pshift_3 = ShiftPaths(Data=join_4, Offset=-1)  # disabled
createatts_2 = CreateAttributes(LayerName=panel_4, Color=graft_2, enableFullPath=False)  # disabled
createhatch_2 = CreateHatch(Bake=toggle_4, Curves=pshift_3, HatchPatternName="Solid", HatchScale=1, HatchRotation=0, Attributes=createatts_2)  # disabled

# ---- group: result
preview = CustomPreview(Geometry=srf_6, Shader=gradient)  # disabled

preview_2 = CustomPreview(Geometry=srf_3, Shader=gradient_2)  # disabled

# ----
removebreptoporbottom = RemoveBrepTopOrBottom(brep=brep_6, bool=True)  # disabled
preview_3 = CustomPreview(Geometry=removebreptoporbottom, Shader=swatch)  # disabled
removebreptoporbottom_2 = RemoveBrepTopOrBottom(brep=brep_9, bool=True)  # disabled
preview_4 = CustomPreview(Geometry=removebreptoporbottom_2, Shader=swatch_2)  # disabled
# Analysis (difference)
subtraction_4 = Subtraction(A=num_8, B=num_5)  # disabled
number_slider_14 = Slider(1000, range=0..1000)  # disabled
panel_5 = Panel("[end]central building height")  # disabled
# Data Reformat
panel_6 = Panel("C:\Users\RYAN\Dropbox (MIT)\01_Work\MAS\03_Winter 2016\Realtime Simulator\Data\Data3\Data")
panel_7 = Panel("[end]random seed number")  # disabled
panel_8 = Panel("[start]random seed number")  # disabled
panel_9 = Panel("[start]central building height")  # disabled
panel_10 = Panel("[end]input building height")  # disabled
panel_11 = Panel("[start]input building height")  # disabled
panel_12 = Panel("[start]output node reads")  # disabled
panel_13 = Panel("[end]output node reads")  # disabled
panel_14 = Panel("[start]node reads difference")  # disabled
panel_15 = Panel("[end]node reads difference")  # disabled

# ---- group: input building height
# Data Export
panel_16 = Panel(num_7)  # disabled

# ---- group: result geo
srf_9 = Surface(reparameterize(flatten(srf_6)))  # disabled

# ---- group: testing nodes
pt_5 = Point(pt_4)

# ----
bnd_3 = Bounds(Numbers=subtraction_4)  # disabled

# ---- group: result difference
num_10 = Number(subtraction_4)  # disabled

# ----
number_slider_15 = Slider(1000, range=0..1000)  # disabled
neg = Negative(Value=number_slider_14)  # disabled
X = UnitX(Factor=neg)  # disabled
X_2 = UnitX(Factor=neg)  # disabled
move_3 = Move(Geometry=brep_9, Motion=X)  # -> Geometry, Transform; disabled
pdecon_2 = Deconstruct(Point=pt_5)  # -> XComponent, YComponent, ZComponent
move_4 = Move(Geometry=brep_6, Motion=X_2)  # -> Geometry, Transform; disabled
remap_4 = RemapNumbers(Value=num_10, Source=bnd_3, Target=Domain(0, 1))  # -> Mapped, Clipped; disabled
preview_5 = CustomPreview(Geometry=move_3.Geometry, Shader=swatch_2)  # disabled
num_11 = Number(item)  # disabled
num_12 = Number(item)
int_4 = Integer(int_2)  # disabled
int_5 = Integer(int_2)

# ---- group: output node reads
panel_17 = Panel(num_8)  # disabled

# ----
subtraction_5 = Subtraction(A=pdecon_2.ZComponent, B=0.1)
preview_6 = CustomPreview(Geometry=move_4.Geometry, Shader=swatch)  # disabled
txt = Text(flatten(num_12))
gradient_3 = Gradient(
    LowerLimit=0,
    UpperLimit=1,
    Parameter=remap_4.Mapped,
    stops=[0: RGB(0, 128, 0), 0.5: RGB(255, 255, 0), 1: RGB(255, 0, 0)])  # disabled
txt_2 = Text(num_11)  # disabled
txt_3 = Text(int_4)  # disabled
txt_4 = Text(flatten(int_5))
X_3 = UnitX(Factor=number_slider_15)  # disabled
int_6 = Integer(int_2)
txt_5 = Text(int_6)
move_5 = Move(Geometry=srf_6, Motion=X_3)  # -> Geometry, Transform; disabled
number_slider_16 = Slider(1000, range=0..1000)  # disabled

# ---- group: node reads difference
panel_18 = Panel(num_10)  # disabled

# ----
merge_3 = Merge(
    Data1=panel_9,
    Data2=txt_2,
    Data3=panel_5,
    Data4=panel_8,
    Data5=txt_3,
    Data6=panel_7,
    Data7=panel_11,
    Data8=panel_16,
    Data9=panel_10,
    Data10=panel_12,
    Data11=panel_17,
    Data12=panel_13,
    Data13=panel_14,
    Data14=panel_18,
    Data15=panel_15)  # disabled

# ---- group: result
preview_7 = CustomPreview(Geometry=move_5.Geometry, Shader=gradient_3)  # disabled

# ----
merge_4 = Merge(Data1=panel_6, Data2=txt_5, Data3=".txt")
merge_5 = Merge(Data1=graft(pdecon_2.XComponent), Data2=graft(pdecon_2.YComponent), Data3=graft(subtraction_5))
join_5 = TextJoin(Text=merge_4)
join_6 = TextJoin(Text=merge_5, Join=",")
X_4 = UnitX(Factor=number_slider_16)  # disabled
X_5 = UnitX(Factor=number_slider_16)  # disabled
pshift_4 = ShiftPaths(Data=join_6, Offset=-1)
panel_19 = Panel(join_5)
move_6 = Move(Geometry=removebreptoporbottom_2, Motion=X_4)  # -> Geometry, Transform; disabled

# ---- group: data to export
panel_20 = Panel(merge_3)  # disabled

# ----
move_7 = Move(Geometry=removebreptoporbottom, Motion=X_5)  # -> Geometry, Transform; disabled
panel_21 = Panel(pshift_4)
txt_6 = Text(flatten(panel_21))
preview_8 = CustomPreview(Geometry=move_6.Geometry, Shader=swatch_2)  # disabled
preview_9 = CustomPreview(Geometry=move_7.Geometry, Shader=swatch)  # disabled
path = FilePath(panel_19)
panel_22 = Panel("C:\Users\RYAN\Dropbox (MIT)\01_Work\MAS\03_Winter 2016\Realtime Simulator\Data\Data3B_2\160206_H25_R")
panel_23 = Panel("C:\Users\RYAN\Dropbox (MIT)\01_Work\Resources\test.txt")  # disabled
panel_24 = Panel(".txt")  # disabled
panel_25 = Panel("C:\Users\RYAN\Dropbox (MIT)\01_Work\MAS\03_Winter 2016\Realtime Simulator\Data")  # disabled
file = ReadFile(File=path, PerLineParse=True)
panel_26 = Panel(file)
int_7 = Integer(int_2)
toggle_append = BooleanToggle(False)
toggle_activate = BooleanToggle(False)
int_8 = Integer(int_2)  # disabled
toggle_append_2 = BooleanToggle(False)  # disabled
toggle_activate_2 = BooleanToggle(False)  # disabled
txt_7 = Text(int_7)
txt_8 = Text(int_8)  # disabled
number_slider_17 = Slider(1000, range=0..1000)  # disabled
merge_6 = Merge(Data1=panel_22, Data2=txt_7, Data3=".txt")
merge_7 = Merge(Data1=panel_25, Data2=txt_8, Data3=panel_24)  # disabled
X_6 = UnitX(Factor=number_slider_17)  # disabled
join_7 = TextJoin(Text=merge_6)
join_8 = TextJoin(Text=merge_7)  # disabled
move_8 = Move(Geometry=srf_6, Motion=X_6)  # -> Geometry, Transform; disabled
panel_27 = Panel(join_7)
panel_28 = Panel(join_8)  # disabled
number_slider_18 = Slider(34, range=0..10000)  # disabled
number_slider_19 = Slider(1258, range=0..10000)  # disabled
dom_8 = ConstructDomain(DomainStart=number_slider_18, DomainEnd=number_slider_19)  # disabled
dom_9 = ConstructDomain(DomainStart=Slider(1261, range=0..10000), DomainEnd=Slider(2485, range=0..10000))
subset_3 = SubList(List=panel_26, Domain=dom_8, Wrap=dom_8)  # -> List, Index; disabled
subset_4 = SubList(List=panel_26, Domain=dom_9, Wrap=dom_9)  # -> List, Index
panel_29 = Panel(subset_3.List)  # disabled

# ---- group: result with ground
# Data File Visualize
# (with Central Building)
num_13 = Number(flatten(panel_29))  # disabled

# ----
bnd_4 = Bounds(Numbers=num_13)  # disabled
remap_5 = RemapNumbers(Value=num_13, Source=bnd_4, Target=Domain(0, 1))  # -> Mapped, Clipped; disabled
gradient_4 = Gradient(
    LowerLimit=0,
    UpperLimit=1,
    Parameter=remap_5.Mapped,
    stops=[0: RGB(0, 128, 0), 0.5: RGB(255, 255, 0), 1: RGB(255, 0, 0)])  # disabled

# ---- group: result
preview_10 = CustomPreview(Geometry=srf_9, Shader=gradient_4)  # disabled

# ----
panel_30 = Panel(subset_4.List)
txt_9 = Text(flatten(panel_30))
merge_8 = Merge(
    Data1="[start]central building height",
    Data2=txt,
    Data3="[end]central building height",
    Data4="[start]random seed number",
    Data5=txt_4,
    Data6="[end]random seed number",
    Data7="[start]input node coordination",
    Data8=txt_6,
    Data9="[end]input node coordination",
    Data10="[start]node reads difference",
    Data11=txt_9,
    Data12="[end]node reads difference")

# ---- group: data to export
panel_31 = Panel(merge_8)

# ---- group: result difference
# Data File Visualize
# (difference)
num_14 = Number(panel_30)  # disabled

# ----
bnd_5 = Bounds(Numbers=num_14)  # disabled
remap_6 = RemapNumbers(Value=num_14, Source=bnd_5, Target=Domain(0, 1))  # -> Mapped, Clipped; disabled
gradient_5 = Gradient(
    LowerLimit=0,
    UpperLimit=1,
    Parameter=remap_6.Mapped,
    stops=[0: RGB(0, 128, 0), 0.5: RGB(255, 255, 0), 1: RGB(255, 0, 0)])  # disabled

# ---- group: result
preview_11 = CustomPreview(Geometry=move_8.Geometry, Shader=gradient_5)  # disabled

# ---- group: write txt file
vb = VBScript(filePath=panel_28, data=panel_20, append=toggle_append_2, activate=toggle_activate_2)  # -> out, A; inputs data: list; disabled
# ---------- vb: VB ----------
    'Code by Victor Leung @ www.dreamationworks.com
    If activate Then

      Dim i As Integer
      Dim aryText(4) As String

      aryText(0) = "Mary WriteLine"
      aryText(1) = "Had"
      aryText(2) = "Another"
      aryText(3) = "Little"
      aryText(4) = "One"

      ' the data is appended to the file. If file doesnt exist, a new file is created
      Dim objWriter As New System.IO.StreamWriter(filePath, append)

      For i = 0 To data.Count - 1
        objWriter.WriteLine(data(i))
      Next

      objWriter.Close()

    End If

    If clearFile Then
      Dim objWriter As New System.IO.StreamWriter(filePath, False)
      objWriter.Close()
    End If
# ---------- end vb ----------

vb_2 = VBScript(filePath=panel_27, data=panel_31, append=toggle_append, activate=toggle_activate)  # -> out, A; inputs data: list; same code as vb

# ==== cluster ExtractBrepTopOrBottom
brep = ClusterInput()
bool = ClusterInput()
brep_2 = Brep(brep)
bool_2 = Boolean(bool)
num = Number(bool_2)
debrep = DeconstructBrep(Brep=brep_2)  # -> Faces, Edges, Vertices
subtraction = Subtraction(A=num, B=0.5)
multiplication = Multiplication(A=subtraction, B=2)
Z = UnitZ(Factor=multiplication)
area = Area(Geometry=debrep.Faces)  # -> Area, Centroid
srf_cp = SurfaceClosestPoint(Point=area.Centroid, Surface=debrep.Faces)  # -> Point, UVPoint, Distance
evalsrf = EvaluateSurface(Surface=debrep.Faces, Point=srf_cp.UVPoint)  # -> Point, Normal, Frame
angle = Angle(VectorA=evalsrf.Normal, VectorB=Z)  # -> Angle, Reflex
equals = Equality(FirstNumber=angle.Angle, SecondNumber=0)  # -> Equality, Inequality
dispatch = Dispatch(List=debrep.Faces, DispatchPattern=equals.Equality)  # -> ListA, ListB
srf = Surface(dispatch.ListA)
srf_2 = ClusterOutput(srf)

# ==== cluster RemoveBrepTopOrBottom
brep = ClusterInput()
bool = ClusterInput()
brep_2 = Brep(brep)
bool_2 = Boolean(bool)
num = Number(bool_2)
debrep = DeconstructBrep(Brep=brep_2)  # -> Faces, Edges, Vertices
subtraction = Subtraction(A=num, B=0.5)
multiplication = Multiplication(A=subtraction, B=2)
Z = UnitZ(Factor=multiplication)
area = Area(Geometry=debrep.Faces)  # -> Area, Centroid
srf_cp = SurfaceClosestPoint(Point=area.Centroid, Surface=debrep.Faces)  # -> Point, UVPoint, Distance
evalsrf = EvaluateSurface(Surface=debrep.Faces, Point=srf_cp.UVPoint)  # -> Point, Normal, Frame
angle = Angle(VectorA=evalsrf.Normal, VectorB=Z)  # -> Angle, Reflex
equals = Equality(FirstNumber=angle.Angle, SecondNumber=0)  # -> Equality, Inequality
dispatch = Dispatch(List=debrep.Faces, DispatchPattern=equals.Inequality)  # -> ListA, ListB
srf = Surface(dispatch.ListA)
join = BrepJoin(Breps=srf)  # -> Breps, Closed
pshift = ShiftPaths(Data=join.Breps, Offset=-1)
brep_3 = Brep(pshift)
brep_4 = ClusterOutput(brep_3)
