# Grasshopper definition 160125_Realtime Simulator_Predict.gh (Grasshopper 0.9.76)
# plug-ins: DIVA.ForGrasshopper, Python Interpreter, HDTReference, LunchBox

# ---- group: grid size
number_slider = Slider(5, range=1..19)
number_slider_2 = Slider(5, range=1..19)

# ---- group: grid dimension
# Realtime Simulator
# 
# by Yan "Ryan" Zhang <ryanz@mit.edu>
# for MIT Media Lab, Changing Place Group, CityScope Project
# March.7th.2016
# Parametric Modelling
number_slider_3 = Slider(34.331, range=1..100)

# ---- group: building dimension
number_slider_4 = Slider(32.578, range=1..100)

# ---- group: building heights
number_slider_5 = Slider(0.1, range=0.1..100)
number_slider_6 = Slider(50, range=1..100)
number_slider_7 = Slider(25, range=1..100)
number_slider_8 = Slider(80, range=1..100)

# ---- group: heightListID
# 1, 3
number_slider_9 = Slider(1, range=0..3)

# ----
# 0, 10, 20, 50
number_slider_10 = Slider(5465, range=0..5465)
# data1: 0 to 5465
# data2: 1 to 4500
number_slider_11 = Slider(4500, range=1..4500)
# Analysis (with Central Building)
python = PythonScript()  # -> Out, A

# ---- group: glass
brep = Brep()
M = Material(Geometry=brep, Geometry_2=brep, Material="GenericCeiling_80")  # -> GeometryWithMaterialAssigned, GeometryWithMaterialAssigned_2

# ---- group: ground
brep_2 = Brep()
M_2 = Material(Geometry=brep_2, Geometry_2=brep_2, Material="GenericCeiling_80")  # -> GeometryWithMaterialAssigned, GeometryWithMaterialAssigned_2

# ----
unit_width = Slider(5, range=0..10)
unit_height = Slider(5, range=0..10)

# ---- group: can not be button!
toggle = BooleanToggle(False)

# ----
unit_width_2 = Slider(1.5, range=0..10)
unit_height_2 = Slider(4.2, range=0..10)

# ---- group: glass
brep_3 = Brep()
M_3 = Material(Geometry=brep_3, Geometry_2=brep_3, Material="GenericCeiling_80")  # -> GeometryWithMaterialAssigned, GeometryWithMaterialAssigned_2

# ---- group: ground
brep_4 = Brep()
M_4 = Material(Geometry=brep_4, Geometry_2=brep_4, Material="GenericCeiling_80")  # -> GeometryWithMaterialAssigned, GeometryWithMaterialAssigned_2

# ----
unit_width_3 = Slider(5, range=0..10)
unit_height_3 = Slider(5, range=0..10)

# ---- group: can not be button!
# Analysis (without Central Building)
toggle_2 = BooleanToggle(False)

# ----
unit_width_4 = Slider(1.5, range=0..10)
unit_height_4 = Slider(4.2, range=0..10)

merge = Merge(Data1=number_slider_5, Data2=number_slider_7, Data3=number_slider_6, Data4=number_slider_8)
int = Integer(number_slider_9)
recgrid = Rectangular(Plane=PlaneXY(0, 0, 0), SizeX=number_slider_3, SizeY=number_slider_3, ExtentX=number_slider, ExtentY=number_slider_2)  # -> Cells, Points
num = Number(unit_width)
num_2 = Number(unit_height)
item = ListItem(List=merge, Index=int, Wrap=False)
num_3 = Number(unit_width_3)
num_4 = Number(unit_height_3)
end = EndPoints(Curve=recgrid.Cells)  # -> Start, End
pshift = ShiftPaths(Data=end.Start, Offset=-1)
lng = ListLength(List=pshift)
eval = Evaluate(F="int((x+1)/2)", x=lng)
subtraction = Subtraction(A=eval, B=2)
dom = ConstructDomain(DomainStart=0, DomainEnd=subtraction)
subtraction_2 = Subtraction(A=lng, B=1)
lng_2 = ListLength(List=merge)
addition = Addition(A=subtraction, B=1)
subset = SubList(List=pshift, Domain=dom, Wrap=False)  # -> List, Index
dom_2 = ConstructDomain(DomainStart=eval, DomainEnd=subtraction_2)
subtraction_3 = Subtraction(A=lng_2, B=1)
item_2 = ListItem(List=pshift, Index=addition, Wrap=True)
subset_2 = SubList(List=pshift, Domain=dom_2, Wrap=False)  # -> List, Index
dom_3 = ConstructDomain(DomainStart=0, DomainEnd=subtraction_3)
merge_2 = Merge(Data1=subset.List, Data2=subset_2.List)
lng_3 = ListLength(List=merge_2)
nodes_offset_out = Slider(0.1, range=0..1)

# ---- group: starting pt (except centeral one)
pt = Point(merge_2)

# ---- group: centeral starting pt
pt_2 = Point(item_2)

# ----
nodes_offset_out_2 = Slider(0.1, range=0..1)
xy = XYPlane(Origin=pt_2)
xy_2 = XYPlane(Origin=pt)
dom_4 = ConstructDomain(DomainStart=0, DomainEnd=Slider(0.1, range=0.1..100))
dom_5 = ConstructDomain(DomainStart=0, DomainEnd=number_slider_4)
dom_6 = ConstructDomain(DomainStart=0, DomainEnd=item)
box = DomainBox(Base=xy, X=dom_5, Y=dom_5, Z=dom_4)
box_2 = DomainBox(Base=xy, X=dom_5, Y=dom_5, Z=dom_6)

# ---- group: center blank replacement
brep_5 = Brep(box)

# ----
swatch = ColourSwatch(SwatchColor=RGBA(191, 191, 191, 75))
swatch_2 = ColourSwatch(SwatchColor=RGBA(171, 190, 255, 150))

# ---- group: center building block geometry
brep_6 = Brep(box_2)

# ----
removebreptoporbottom = RemoveBrepTopOrBottom(brep=brep_6, bool=True)
preview = CustomPreview(Geometry=removebreptoporbottom, Shader=swatch_2)
# Data Reformat
panel = Panel("C:\Users\RYAN\Dropbox (MIT)\01_Work\MAS\Realtime Simulator\Data2\160110_H80_R")
neg = Negative(Value=Slider(1000, range=0..1000))
X = UnitX(Factor=neg)
X_2 = UnitX(Factor=neg)
move = Move(Geometry=brep_6, Motion=X)  # -> Geometry, Transform
preview_2 = CustomPreview(Geometry=move.Geometry, Shader=swatch_2)
num_5 = Number(item)
num_6 = Number(item)
txt = Text(flatten(num_6))
txt_2 = Text(num_5)
X_3 = UnitX(Factor=Slider(1000, range=0..1000))
number_slider_12 = Slider(1000, range=0..1000)
X_4 = UnitX(Factor=number_slider_12)
X_5 = UnitX(Factor=number_slider_12)
move_2 = Move(Geometry=removebreptoporbottom, Motion=X_4)  # -> Geometry, Transform
preview_3 = CustomPreview(Geometry=move_2.Geometry, Shader=swatch_2)

# ---- group: randam seed for context
number_slider_13 = Slider(984, range=0..10000)

# ----
int_2 = Integer(number_slider_13)
random = Random(Range=Domain(0, 1), Number=lng_3, Seed=int_2)
graph = GraphMapper(
    random,
    x0=0,
    x1=1,
    y0=0,
    y1=1,
    container_name="Bezier",
    cpx=[0, 0.5129005909, 1, 1],
    cpy=[0, 0.00346583128, 0.3901748657, 1])
remap = RemapNumbers(Value=graph, Source=Domain(0, 1), Target=dom_3)  # -> Mapped, Clipped
int_3 = Integer(remap.Mapped)
item_3 = ListItem(List=merge, Index=int_3, Wrap=True)
dom_7 = ConstructDomain(DomainStart=0, DomainEnd=item_3)
box_3 = DomainBox(Base=xy_2, X=dom_5, Y=dom_5, Z=dom_7)

# ---- group: context geometry
brep_7 = Brep(box_3)

# ---- group: slab
brep_8 = Brep([brep_7, brep_6])
M_5 = Material(Geometry=brep_8, Geometry_2=brep_8, Material="GenericCeiling_80")  # -> GeometryWithMaterialAssigned, GeometryWithMaterialAssigned_2

# ---- group: node base srf
brep_9 = Brep([brep_7, brep_6])

# ---- group: slab
brep_10 = Brep([brep_7, brep_5])
M_6 = Material(Geometry=brep_10, Geometry_2=brep_10, Material="GenericCeiling_80")  # -> GeometryWithMaterialAssigned, GeometryWithMaterialAssigned_2

# ---- group: node base srf
brep_11 = Brep([brep_7, brep_5])

# ----
extractbreptoporbottom = ExtractBrepTopOrBottom(brep=brep_9, bool=True)
extractbreptoporbottom_2 = ExtractBrepTopOrBottom(brep=brep_11, bool=True)
debrep = DeconstructBrep(Brep=brep_9)  # -> Faces, Edges, Vertices
debrep_2 = DeconstructBrep(Brep=brep_11)  # -> Faces, Edges, Vertices
srf = Surface(reparameterize(flatten(extractbreptoporbottom)))
srf_2 = Surface(reparameterize(flatten(extractbreptoporbottom_2)))

# ---- group: glass srf
srf_3 = Surface(reparameterize(graft(srf)))

srf_4 = Surface(reparameterize(graft(srf_2)))

# ----
dim = Dimensions(Surface=srf_3)  # -> UDimension, VDimension
dim_2 = Dimensions(Surface=srf_4)  # -> UDimension, VDimension
area = Area(Geometry=srf)  # -> Area, Centroid
division = Division(A=dim.VDimension, B=num_2)
division_2 = Division(A=dim.UDimension, B=num)
division_3 = Division(A=dim_2.VDimension, B=num_4)
division_4 = Division(A=dim_2.UDimension, B=num_3)
divide = DivideDomain²(Domain=srf_3, UCount=division_2, VCount=division)
pdecon = Deconstruct(Point=area.Centroid)  # -> XComponent, YComponent, ZComponent
divide_2 = DivideDomain²(Domain=srf_4, UCount=division_4, VCount=division_3)
subsrf = Isotrim(Surface=srf_3, Domain=divide)
subsrf_2 = Isotrim(Surface=srf_4, Domain=divide_2)

# ---- group: input building height
num_7 = Number(pdecon.ZComponent)

# ---- group: result geo
srf_5 = Surface(reparameterize(flatten(subsrf)))

srf_6 = Surface(reparameterize(flatten(subsrf_2)))

# ----
join = BrepJoin(Breps=flatten(brep_9))  # -> Breps, Closed
area_2 = Area(Geometry=srf_5)  # -> Area, Centroid
join_2 = BrepJoin(Breps=flatten(brep_11))  # -> Breps, Closed
area_3 = Area(Geometry=srf_6)  # -> Area, Centroid
mesh = MeshBrep(
    Brep=join.Breps,
    Settings={GridMaxCount=0, GridMinCount=16, JaggedSeams=False, MaxEdgeLength=0, MinEdgeLength=0.0001, MinTolerance=0, Refine=True, RefineAngle=0, RelativeTolerance=0.65, SimplePlanes=True, Tolerance=0})
mesh_2 = MeshBrep(
    Brep=join_2.Breps,
    Settings={GridMaxCount=0, GridMinCount=16, JaggedSeams=False, MaxEdgeLength=0, MinEdgeLength=0.0001, MinTolerance=0, Refine=True, RefineAngle=0, RelativeTolerance=0.65, SimplePlanes=True, Tolerance=0})
mjoin = MeshJoin(Meshes=mesh)
meshcp = MeshClosestPoint(Point=area_2.Centroid, Mesh=mjoin)  # -> Point, Index, Parameter
meval = MeshEval(Mesh=mjoin, Parameter=meshcp.Parameter)  # -> Point, Normal, Colour
mjoin_2 = MeshJoin(Meshes=mesh_2)
meshcp_2 = MeshClosestPoint(Point=area_3.Centroid, Mesh=mjoin_2)  # -> Point, Index, Parameter
meval_2 = MeshEval(Mesh=mjoin_2, Parameter=meshcp_2.Parameter)  # -> Point, Normal, Colour
amp = Amplitude(Vector=meval.Normal, Amplitude=nodes_offset_out)

# ---- group: optional
# default: -ab 2 -ad 1000 -as 20 -ar 300 -aa 0.1
# low1: -ab 2 -ad 600 -as 12 -ar 200 -aa 0.1
# low2: -ab 2 -ad 450 -as 9 -ar 150 -aa 0.1
# low3: -ab 2 -ad 300 -as 6 -ar 100 -aa 0.1
vec = Vector(amp)

# ----
amp_2 = Amplitude(Vector=meval_2.Normal, Amplitude=nodes_offset_out_2)

# ---- group: optional
# default: -ab 2 -ad 1000 -as 20 -ar 300 -aa 0.1
# low1: -ab 2 -ad 600 -as 12 -ar 200 -aa 0.1
# low2: -ab 2 -ad 450 -as 9 -ar 150 -aa 0.1
# low3: -ab 2 -ad 300 -as 6 -ar 100 -aa 0.1
vec_2 = Vector(amp_2)

# ----
move_3 = Move(Geometry=area_2.Centroid, Motion=amp)  # -> Geometry, Transform
move_4 = Move(Geometry=area_3.Centroid, Motion=amp_2)  # -> Geometry, Transform

# ---- group: testing nodes
pt_3 = Point(move_3.Geometry)

# ----
diva_daylight = DIVADaylightAnalysisForGH(
    ProjectName="PROJECT_NAME",
    GeometryWithRadianceMaterialReference=[M.GeometryWithMaterialAssigned_2, M_5.GeometryWithMaterialAssigned_2, M_2.GeometryWithMaterialAssigned_2],
    AnalysisNodes=pt_3,
    WriteOnly=False,
    RunSimulation=toggle,
    ProjectName_2="PROJECT_NAME",
    GeometryWithRadianceMaterialReference_2=[M.GeometryWithMaterialAssigned_2, M_5.GeometryWithMaterialAssigned_2, M_2.GeometryWithMaterialAssigned_2],
    AnalysisNodes_2=pt_3,
    WriteOnly_2=False,
    RunSimulation_2=toggle,
    Climate_Occ=0,
    Climate_RadParam="-ab 2 -ad 1000 -as 20 -ar 300 -aa 0.1",
    DF_RadParam="-ab 2 -ad 1000 -as 20 -ar 300 -aa 0.1",
    DimIrr=200,
    DirIrr=800,
    Ill_RadParam="-ab 2 -ad 1000 -as 20 -ar 300 -aa 0.1",
    Insol_CustomDates=False,
    Insol_EndDay=30,
    Insol_EndMonth=11,
    Insol_RadParam="-ab 2 -ad 1000 -as 20 -ar 300 -aa 0.1",
    Insol_StartDay=0,
    Insol_StartMonth=0,
    Insol_Vis_RadParam="-ab 2 -ad 1000 -as 20 -ar 300 -aa 0.1",
    InsolationPeriod=0,
    Irr_FC_legend_max="auto",
    Light_Operation=3,
    Lighting_Param="-W 250.0 -Set 300 -Loss 20 -Standby 0.0",
    Location="USA_MA_Boston-Logan.Intl.AP.725090_TMY3.epw",
    Lum_FC_legend_max="auto",
    MDH_Input=False,
    MinIll=300,
    OutputStates=True,
    Quality=0,
    Rhino_Include=False,
    SimulationType=0,
    SkyCond=0,
    StartDay=20,
    StartHour=12,
    StartMonth=5,
    Vis_RadParam="-ps 8 -pt .15 -pj .6 -dj 0 -ds .5 -dt .5 -dc .25 -dr 0 -dp 64 -st .85 -ab 2 -aa .25 -ar 16 -ad 512 -as 128 -lr 4 -lw .05 -av 0 0 0",
    X_Resolution=600,
    Y_Resolution=400)  # -> OutputMessage, MetricSolarIrradiation, OutputMessage_2, MetricSolarIrradiation_2

# ---- group: result with ground
num_8 = Number(diva_daylight.MetricSolarIrradiation_2)

# ---- group: Internalise to record the result
num_9 = Number(diva_daylight.MetricSolarIrradiation_2)

# ----
bnd = Bounds(Numbers=num_8)
remap_2 = RemapNumbers(Value=num_8, Source=bnd, Target=Domain(0, 1))  # -> Mapped, Clipped
gradient = Gradient(
    LowerLimit=0,
    UpperLimit=1,
    Parameter=remap_2.Mapped,
    stops=[0: RGB(0, 128, 0), 0.5: RGB(255, 255, 0), 1: RGB(255, 0, 0)])

# ---- group: BAKE RESULT HATCH
srf_7 = Surface(srf_5)
col = Colour(gradient)
edges = BrepEdges(Brep=srf_7)  # -> Naked, Interior, NonManifold
join_3 = JoinCurves(Curves=edges.Naked, Preserve=False)
graft = GraftTree(Tree=col, IncludeEmptyLists=True, IncludeNullItems=True)
pshift_2 = ShiftPaths(Data=join_3, Offset=-1)
createatts = CreateAttributes(LayerName="result hatch 01", Color=graft, enableFullPath=False)
createhatch = CreateHatch(Bake=Toggle(False), Curves=pshift_2, HatchPatternName="Solid", HatchScale=1, HatchRotation=0, Attributes=createatts)

# ---- group: result
preview_4 = CustomPreview(Geometry=srf_5, Shader=gradient)

# ---- group: testing nodes
pt_4 = Point(move_4.Geometry)

# ----
diva_daylight_2 = DIVADaylightAnalysisForGH(
    ProjectName="PROJECT_NAME",
    GeometryWithRadianceMaterialReference=[M_3.GeometryWithMaterialAssigned_2, M_6.GeometryWithMaterialAssigned_2, M_4.GeometryWithMaterialAssigned_2],
    AnalysisNodes=pt_4,
    WriteOnly=False,
    RunSimulation=toggle_2,
    ProjectName_2="PROJECT_NAME",
    GeometryWithRadianceMaterialReference_2=[M_3.GeometryWithMaterialAssigned_2, M_6.GeometryWithMaterialAssigned_2, M_4.GeometryWithMaterialAssigned_2],
    AnalysisNodes_2=pt_4,
    WriteOnly_2=False,
    RunSimulation_2=toggle_2,
    Climate_Occ=0,
    Climate_RadParam="-ab 2 -ad 1000 -as 20 -ar 300 -aa 0.1",
    DF_RadParam="-ab 2 -ad 1000 -as 20 -ar 300 -aa 0.1",
    DimIrr=200,
    DirIrr=800,
    Ill_RadParam="-ab 2 -ad 1000 -as 20 -ar 300 -aa 0.1",
    Insol_CustomDates=False,
    Insol_EndDay=30,
    Insol_EndMonth=11,
    Insol_RadParam="-ab 2 -ad 1000 -as 20 -ar 300 -aa 0.1",
    Insol_StartDay=0,
    Insol_StartMonth=0,
    Insol_Vis_RadParam="-ab 2 -ad 1000 -as 20 -ar 300 -aa 0.1",
    InsolationPeriod=0,
    Irr_FC_legend_max="auto",
    Light_Operation=3,
    Lighting_Param="-W 250.0 -Set 300 -Loss 20 -Standby 0.0",
    Location="USA_MA_Boston-Logan.Intl.AP.725090_TMY3.epw",
    Lum_FC_legend_max="auto",
    MDH_Input=False,
    MinIll=300,
    OutputStates=True,
    Quality=0,
    Rhino_Include=False,
    SimulationType=0,
    SkyCond=0,
    StartDay=20,
    StartHour=12,
    StartMonth=5,
    Vis_RadParam="-ps 8 -pt .15 -pj .6 -dj 0 -ds .5 -dt .5 -dc .25 -dr 0 -dp 64 -st .85 -ab 2 -aa .25 -ar 16 -ad 512 -as 128 -lr 4 -lw .05 -av 0 0 0",
    X_Resolution=600,
    Y_Resolution=400)  # -> OutputMessage, MetricSolarIrradiation, OutputMessage_2, MetricSolarIrradiation_2

# ---- group: result with ground
num_10 = Number(diva_daylight_2.MetricSolarIrradiation_2)

# ---- group: Internalise to record the result
num_11 = Number(diva_daylight_2.MetricSolarIrradiation_2)

# ----
bnd_2 = Bounds(Numbers=num_10)
remap_3 = RemapNumbers(Value=num_10, Source=bnd, Target=Domain(0, 1))  # -> Mapped, Clipped
gradient_2 = Gradient(
    LowerLimit=0,
    UpperLimit=1,
    Parameter=remap_3.Mapped,
    stops=[0: RGB(0, 128, 0), 0.5: RGB(255, 255, 0), 1: RGB(255, 0, 0)])

# ---- group: BAKE RESULT HATCH
srf_8 = Surface(srf_6)
col_2 = Colour(gradient_2)
edges_2 = BrepEdges(Brep=srf_8)  # -> Naked, Interior, NonManifold
join_4 = JoinCurves(Curves=edges_2.Naked, Preserve=False)
graft_2 = GraftTree(Tree=col_2, IncludeEmptyLists=True, IncludeNullItems=True)
pshift_3 = ShiftPaths(Data=join_4, Offset=-1)
createatts_2 = CreateAttributes(LayerName="result hatch 01", Color=graft_2, enableFullPath=False)
createhatch_2 = CreateHatch(Bake=Toggle(False), Curves=pshift_3, HatchPatternName="Solid", HatchScale=1, HatchRotation=0, Attributes=createatts_2)

# ---- group: result
preview_5 = CustomPreview(Geometry=srf_6, Shader=gradient_2)

# ----
removebreptoporbottom_2 = RemoveBrepTopOrBottom(brep=brep_7, bool=True)
preview_6 = CustomPreview(Geometry=removebreptoporbottom_2, Shader=swatch)
# Analysis (difference)
subtraction_4 = Subtraction(A=num_8, B=num_10)

# ---- group: input building height
# Data Export
panel_2 = Panel(num_7)

# ---- group: result geo
srf_9 = Surface(reparameterize(flatten(srf_5)))

# ---- group: testing nodes
pt_5 = Point(pt_3)

# ----
bnd_3 = Bounds(Numbers=subtraction_4)

# ---- group: result difference
num_12 = Number(subtraction_4)

# ----
pdecon_2 = Deconstruct(Point=pt_5)  # -> XComponent, YComponent, ZComponent
move_5 = Move(Geometry=brep_7, Motion=X_2)  # -> Geometry, Transform
remap_4 = RemapNumbers(Value=num_12, Source=bnd_3, Target=Domain(0, 1))  # -> Mapped, Clipped
int_4 = Integer(int_2)
int_5 = Integer(int_2)

# ---- group: output node reads
panel_3 = Panel(num_8)

# ----
subtraction_5 = Subtraction(A=pdecon_2.ZComponent, B=0.1)
preview_7 = CustomPreview(Geometry=move_5.Geometry, Shader=swatch)
gradient_3 = Gradient(
    LowerLimit=0,
    UpperLimit=1,
    Parameter=remap_4.Mapped,
    stops=[0: RGB(0, 128, 0), 0.5: RGB(255, 255, 0), 1: RGB(255, 0, 0)])
txt_3 = Text(int_4)
txt_4 = Text(flatten(int_5))
int_6 = Integer(int_2)
txt_5 = Text(int_6)
move_6 = Move(Geometry=srf_5, Motion=X_3)  # -> Geometry, Transform

# ---- group: node reads difference
panel_4 = Panel(num_12)

# ----
merge_3 = Merge(
    Data1="[start]central building height",
    Data2=txt_2,
    Data3="[end]central building height",
    Data4="[start]random seed number",
    Data5=txt_3,
    Data6="[end]random seed number",
    Data7="[start]input building height",
    Data8=panel_2,
    Data9="[end]input building height",
    Data10="[start]output node reads",
    Data11=panel_3,
    Data12="[end]output node reads",
    Data13="[start]node reads difference",
    Data14=panel_4,
    Data15="[end]node reads difference")

# ---- group: result
preview_8 = CustomPreview(Geometry=move_6.Geometry, Shader=gradient_3)

# ----
merge_4 = Merge(Data1=panel, Data2=txt_5, Data3=".txt")
merge_5 = Merge(Data1=graft(pdecon_2.XComponent), Data2=graft(pdecon_2.YComponent), Data3=graft(subtraction_5))
join_5 = TextJoin(Text=merge_4)
join_6 = TextJoin(Text=merge_5, Join=",")
pshift_4 = ShiftPaths(Data=join_6, Offset=-1)
panel_5 = Panel(join_5)

# ---- group: data to export
panel_6 = Panel(merge_3)

# ----
move_7 = Move(Geometry=removebreptoporbottom_2, Motion=X_5)  # -> Geometry, Transform
panel_7 = Panel(pshift_4)
txt_6 = Text(flatten(panel_7))
preview_9 = CustomPreview(Geometry=move_7.Geometry, Shader=swatch)
number_slider_14 = Slider(300, range=0..1000)
path = FilePath("C:\Users\RYAN\Dropbox (MIT)\01_Work\MAS\Realtime Simulator\validation\160114_H25_R983.txt")
path_2 = FilePath("C:\Users\RYAN\Dropbox (MIT)\01_Work\MAS\Realtime Simulator\validation\160114_H25_R984.txt")
path_3 = FilePath("C:\Users\RYAN\Dropbox (MIT)\01_Work\MAS\Realtime Simulator\validation\160114_H25_R985.txt")
path_4 = FilePath(panel_5)
path_5 = FilePath("C:\Users\RYAN\Dropbox (MIT)\01_Work\MAS\Realtime Simulator\validation\160114_H25_R981_prediction.txt")
path_6 = FilePath("C:\Users\RYAN\Dropbox (MIT)\01_Work\MAS\Realtime Simulator\validation\160114_H25_R982_prediction.txt")
path_7 = FilePath("C:\Users\RYAN\Dropbox (MIT)\01_Work\MAS\Realtime Simulator\validation\160114_H25_R983_prediction.txt")
path_8 = FilePath("C:\Users\RYAN\Dropbox (MIT)\01_Work\MAS\Realtime Simulator\validation\160114_H25_R984_prediction.txt")
path_9 = FilePath("C:\Users\RYAN\Dropbox (MIT)\01_Work\MAS\Realtime Simulator\validation\160114_H25_R985_prediction.txt")
panel_8 = Panel("C:\Users\RYAN\Dropbox (MIT)\01_Work\MAS\Realtime Simulator\Data2B\160114_H80_R")
panel_9 = Panel("C:\Users\RYAN\Dropbox (MIT)\01_Work\Resources\test.txt")
panel_10 = Panel("C:\Users\RYAN\Dropbox (MIT)\01_Work\MAS\Realtime Simulator\Data\160110_H25_R")

# ---- group: 981
path_10 = FilePath("C:\Users\RYAN\Dropbox (MIT)\01_Work\MAS\03_Winter 2016\Realtime Simulator\validation\160114_H25_R981.txt")

# ---- group: 984
path_11 = FilePath("C:\Users\RYAN\Dropbox (MIT)\01_Work\MAS\03_Winter 2016\Realtime Simulator\validation\160114_H25_R984.txt")

# ----
file = ReadFile(File=path_11, PerLineParse=True)
neg_2 = Negative(Value=number_slider_14)
dom_8 = ConstructDomain(DomainStart=neg_2, DomainEnd=number_slider_14)
panel_11 = Panel(file)
int_7 = Integer(int_2)
toggle_append = BooleanToggle(False)
toggle_activate = BooleanToggle(False)
int_8 = Integer(int_2)
toggle_append_2 = BooleanToggle(False)
toggle_activate_2 = BooleanToggle(False)
txt_7 = Text(int_7)
txt_8 = Text(int_8)
merge_6 = Merge(Data1=panel_8, Data2=txt_7, Data3=".txt")
merge_7 = Merge(Data1=panel_10, Data2=txt_8, Data3=".txt")
X_6 = UnitX(Factor=Slider(1000, range=0..1000))
join_7 = TextJoin(Text=merge_6)
join_8 = TextJoin(Text=merge_7)
move_8 = Move(Geometry=srf_5, Motion=X_6)  # -> Geometry, Transform
panel_12 = Panel(join_7)
panel_13 = Panel(join_8)
dom_9 = ConstructDomain(DomainStart=Slider(34, range=0..10000), DomainEnd=Slider(1258, range=0..10000))
dom_10 = ConstructDomain(DomainStart=Slider(1234, range=0..10000), DomainEnd=Slider(2458, range=0..10000))
subset_3 = SubList(List=panel_11, Domain=dom_9, Wrap=dom_9)  # -> List, Index
subset_4 = SubList(List=panel_11, Domain=dom_10, Wrap=dom_10)  # -> List, Index
panel_14 = Panel(subset_3.List)

# ---- group: result with ground
# Data File Visualize
# (with Central Building)
num_13 = Number(flatten(panel_14))

# ----
bnd_4 = Bounds(Numbers=num_13)
remap_5 = RemapNumbers(Value=num_13, Source=bnd_4, Target=Domain(0, 1))  # -> Mapped, Clipped
gradient_4 = Gradient(
    LowerLimit=0,
    UpperLimit=1,
    Parameter=remap_5.Mapped,
    stops=[0: RGB(0, 128, 0), 0.5: RGB(255, 255, 0), 1: RGB(255, 0, 0)])

# ---- group: result
preview_10 = CustomPreview(Geometry=srf_9, Shader=gradient_4)

# ----
panel_15 = Panel(subset_4.List)

# ---- group: write txt file
vb = VBScript(filePath=panel_13, data=panel_6, append=toggle_append_2, activate=toggle_activate_2)  # -> out, A; inputs data: list
# ---------- vb: VB ----------
    'Code by Victor Leung @ www.dreamationworks.com
    If activate Then

      Dim i As Integer
      Dim aryText(4) As String

      aryText(0) = "Mary WriteLine"
      aryText(1) = "Had"
      aryText(2) = "Another"
      aryText(3) = "Little"
      aryText(4) = "One"

      ' the data is appended to the file. If file doesnt exist, a new file is created
      Dim objWriter As New System.IO.StreamWriter(filePath, append)

      For i = 0 To data.Count - 1
        objWriter.WriteLine(data(i))
      Next

      objWriter.Close()

    End If

    If clearFile Then
      Dim objWriter As New System.IO.StreamWriter(filePath, False)
      objWriter.Close()
    End If
# ---------- end vb ----------

# ----
num_14 = Number(panel_15)
excelread = ExcelReader(
    ReadToggle=Toggle(True),
    Worksheet=1,
    Column=Slider(4, range=0..100),
    RowStart=Slider(1, range=0..1),
    RowEnd=Slider(1225, range=0..10000))  # -> Exceptions, ExcelData
panel_16 = Panel(excelread.ExcelData)
num_15 = Number(panel_16)
num_16 = Number(num_15)
txt_9 = Text(flatten(num_16))
merge_8 = Merge(
    Data1="[start]central building height",
    Data2=txt,
    Data3="[end]central building height",
    Data4="[start]random seed number",
    Data5=txt_4,
    Data6="[end]random seed number",
    Data7="[start]input node coordination",
    Data8=txt_6,
    Data9="[end]input node coordination",
    Data10="[start]node reads difference",
    Data11=txt_9,
    Data12="[end]node reads difference")

# ---- group: data to export
panel_17 = Panel(merge_8)

# ---- group: result difference
# Data File Visualize
# (difference)
num_17 = Number(num_16)

# ----
bnd_5 = Bounds(Numbers=num_17)
remap_6 = RemapNumbers(Value=num_17, Source=dom_8, Target=Domain(0, 1))  # -> Mapped, Clipped
gradient_5 = Gradient(
    LowerLimit=0,
    UpperLimit=1,
    Parameter=remap_6.Mapped,
    stops=[0: RGB(0, 128, 0), 0.5: RGB(255, 255, 0), 1: RGB(255, 0, 0)])

# ---- group: result
preview_11 = CustomPreview(Geometry=move_8.Geometry, Shader=gradient_5)

# ---- group: write txt file
vb_2 = VBScript(filePath=panel_12, data=panel_17, append=toggle_append, activate=toggle_activate)  # -> out, A; inputs data: list; same code as vb

# ==== cluster ExtractBrepTopOrBottom
brep = ClusterInput()
bool = ClusterInput()
brep_2 = Brep(brep)
bool_2 = Boolean(bool)
num = Number(bool_2)
debrep = DeconstructBrep(Brep=brep_2)  # -> Faces, Edges, Vertices
subtraction = Subtraction(A=num, B=0.5)
multiplication = Multiplication(A=subtraction, B=2)
Z = UnitZ(Factor=multiplication)
area = Area(Geometry=debrep.Faces)  # -> Area, Centroid
srf_cp = SurfaceClosestPoint(Point=area.Centroid, Surface=debrep.Faces)  # -> Point, UVPoint, Distance
evalsrf = EvaluateSurface(Surface=debrep.Faces, Point=srf_cp.UVPoint)  # -> Point, Normal, Frame
angle = Angle(VectorA=evalsrf.Normal, VectorB=Z)  # -> Angle, Reflex
equals = Equality(FirstNumber=angle.Angle, SecondNumber=0)  # -> Equality, Inequality
dispatch = Dispatch(List=debrep.Faces, DispatchPattern=equals.Equality)  # -> ListA, ListB
srf = Surface(dispatch.ListA)
srf_2 = ClusterOutput(srf)

# ==== cluster RemoveBrepTopOrBottom
brep = ClusterInput()
bool = ClusterInput()
brep_2 = Brep(brep)
bool_2 = Boolean(bool)
num = Number(bool_2)
debrep = DeconstructBrep(Brep=brep_2)  # -> Faces, Edges, Vertices
subtraction = Subtraction(A=num, B=0.5)
multiplication = Multiplication(A=subtraction, B=2)
Z = UnitZ(Factor=multiplication)
area = Area(Geometry=debrep.Faces)  # -> Area, Centroid
srf_cp = SurfaceClosestPoint(Point=area.Centroid, Surface=debrep.Faces)  # -> Point, UVPoint, Distance
evalsrf = EvaluateSurface(Surface=debrep.Faces, Point=srf_cp.UVPoint)  # -> Point, Normal, Frame
angle = Angle(VectorA=evalsrf.Normal, VectorB=Z)  # -> Angle, Reflex
equals = Equality(FirstNumber=angle.Angle, SecondNumber=0)  # -> Equality, Inequality
dispatch = Dispatch(List=debrep.Faces, DispatchPattern=equals.Inequality)  # -> ListA, ListB
srf = Surface(dispatch.ListA)
join = BrepJoin(Breps=srf)  # -> Breps, Closed
pshift = ShiftPaths(Data=join.Breps, Offset=-1)
brep_3 = Brep(pshift)
brep_4 = ClusterOutput(brep_3)
