# Grasshopper definition 160217_python test 2.gh (Grasshopper 0.9.76)
# plug-ins: Python Interpreter

samples = Slider(83, range=2..200)
degree = Slider(6, range=1..12)
pt = Point([Point(0, 3, 0), Point(2, 2, 0), Point(3, 1, 0), Point(4, 0, 0), Point(5, 5, 0), Point(7, 3, 0), Point(8, 2, 0), Point(11, 3, 0), Point(13, 0, 0)])
samples_2 = Slider(83, range=2..200)
degree_2 = Slider(6, range=1..12)
# Polynomial Fit
# NumPy in Rhino 5.0 32bits
# This example shows how to run a simple
# NumPy script from within GhPython 0.4.6.
# 
# This script needs to run in Rhino 5 32-bit,
# as numpy cannot currently use 64-bit platforms.
pt_2 = Point([Point(0, 3, 0), Point(2, 2, 0), Point(3, 1, 0), Point(4, 0, 0), Point(5, 5, 0), Point(7, 3, 0), Point(8, 2, 0), Point(11, 3, 0), Point(13, 0, 0)])
python = PythonScript(pts=pt, degree=degree, x=samples)  # -> out, pl; inputs pts: list, x: list
# ---------- python: Python ----------
# you can adjust referenced modules here:

#pcks = "C:\\Program Files (x86)\\IronPython 2.7\\Lib\\site-packages\\"
#dlls  = "C:\\Program Files (x86)\\IronPython 2.7\\DLLs\\"
pcks = "C:\\Python27\\Lib\\site-packages\\"
dlls  = "C:\\Python27\\DLLs\\"


# no need to change after this line
# -------------------------------------

import sys
if not pcks in sys.path:
    sys.path.append(pcks)
if not dlls in sys.path:
    sys.path.append(dlls)

import clr
clr.AddReference("mtrand")



from numpy import polyfit 
from numpy import poly1d 
import rhinoscriptsyntax as rs

if pts and degree > 0:
    x_coord = [rs.PointCoordinates(pt).X for pt in pts]
    y_coord = [rs.PointCoordinates(pt).Y for pt in pts]
     
    eq = numpy.polyfit(x_coord, y_coord, degree)
    fitfunc = numpy.poly1d(eq)
     
    min = rs.PointCoordinates(pts[0]).X
    max = rs.PointCoordinates(pts[len(pts)-1]).X
    dist = (max - min) / (steps - 1)
    
    fit_points = []
    for i in range(int(steps)):
        x = dist * i + min
        y = fitfunc(x)
        fit_points.append((x, y, 0))
        
    pl = rs.AddPolyline(fit_points)
# ---------- end python ----------
# Getting started instructions
# - install numpy and scipy from
#  http://www.enthought.com/repo/.iron/
# 
# - turn XFrames on with the EditPythonScript
#  command (Tools -> Options -> Script Engine)
# 
# - adjust library locations in the script
#  (double-click the component)
polyfit = PythonScript(pts=pt_2, degree=degree_2, steps=samples_2, GhMemory=-10)  # -> pl; inputs pts: list
# ---------- polyfit: Python ----------
# you can adjust referenced modules here:

#pcks = "C:\\Program Files (x86)\\IronPython 2.7\\Lib\\site-packages\\"
#dlls  = "C:\\Program Files (x86)\\IronPython 2.7\\DLLs\\"
pcks = "C:\\Python27\\Lib\\site-packages\\"
dlls  = "C:\\Python27\\DLLs\\"


# no need to change after this line
# -------------------------------------

import sys
if not pcks in sys.path:
    sys.path.append(pcks)
if not dlls in sys.path:
    sys.path.append(dlls)

import clr
clr.AddReference("mtrand")
 
import numpy
import rhinoscriptsyntax as rs

if pts and degree > 0:
    x_coord = [rs.PointCoordinates(pt).X for pt in pts]
    y_coord = [rs.PointCoordinates(pt).Y for pt in pts]
     
    eq = numpy.polyfit(x_coord, y_coord, degree)
    fitfunc = numpy.poly1d(eq)
     
    min = rs.PointCoordinates(pts[0]).X
    max = rs.PointCoordinates(pts[len(pts)-1]).X
    dist = (max - min) / (steps - 1)
    
    fit_points = []
    for i in range(int(steps)):
        x = dist * i + min
        y = fitfunc(x)
        fit_points.append((x, y, 0))
        
    pl = rs.AddPolyline(fit_points)
# ---------- end polyfit ----------
