# Grasshopper definition 160217_python test.gh (Grasshopper 0.9.76)
# plug-ins: Python Interpreter

number_slider = Slider(9, range=0..9)
number_slider_2 = Slider(1, range=0..1)
# Tests for importing Numpy
# http://www.grasshopper3d.com/forum/topics/numpy-for-iron-python-with-ghpython-mtrand-exceptions
# import sys
#       print sys.path
#       sys.path.append(r'c:\Program Files (x86)\IronPython 2.7')
#       sys.path.append(r'c:\Program Files (x86)\IronPython 2.7\DLLs')
#       sys.path.append(r'c:\Program Files (x86)\IronPython 2.7\Lib')
#       sys.path.append(r'c:\Program Files (x86)\IronPython 2.7\Lib\site-packages')
# 
#       import clr
#       clr.AddReference('mtrand.dll')
#       import numpy
#       print numpy.__version__
# https://stevebaer.wordpress.com/2011/06/27/numpy-and-scipy-in-rhinopython/
# Tests for calling external python script like cmd with arguments
# import os
# import subprocess
# import sys
# 
# 
# # call os in gh, and pass input parameters,
# # and use subprocess to call a python script with arguement,
# # output to a file and have gh read csv.
panel = Panel(""">>> import numpy
>>> numpy.__version__
'1.9.2rc1'""")
addition = Addition(A=number_slider, B=number_slider_2)
python = PythonScript(writeFile=Toggle(False), x=number_slider, y=number_slider_2, z=addition)  # -> out, a
# ---------- python: Python ----------
# -*- coding: utf-8 -*-
"""
Created on Thu Feb 18 00:04:53 2016

@author: RYAN
"""

str01 = "x:"+str(x)+"; y:"+str(y)+"; z:"+str(z)
print str01

if writeFile: 
    from subprocess import call
    call(["python", "C:\\Users\\RYAN\\Documents\\GitHub\\Realtime_Simulator\\Python\\160217_test04_YZ.py", str01, str(z)])
    # the print in called python script will not work


"""
call os in gh, and pass input parameters, 
and use subprocess to call a python script with arguement, 
output to a file and have gh read csv. 
"""
# ---------- end python ----------
panel_2 = Panel(python.a)
panel_3 = Panel(python.out)
