# Grasshopper definition 160219_Realtime Simulator_Python_loop.gh (Grasshopper 0.9.76)
# plug-ins: Python Interpreter

# Data File Visualize (difference)
path = FilePath("C:\Users\RYAN\Documents\GitHub\Realtime_Sim\Data\prediction.txt")
panel = Panel(path)

# ---- group: grid size
number_slider = Slider(5, range=1..19)
number_slider_2 = Slider(5, range=1..19)

# ---- group: grid dimension
# Realtime Simulator
# 
# by Yan "Ryan" Zhang <ryanz@mit.edu>
# for MIT Media Lab, Changing Place Group, CityScope Project
# March.7th.2016
# Parametric Modelling
number_slider_3 = Slider(34.331, range=1..100)

# ---- group: building dimension
number_slider_4 = Slider(32.578, range=1..100)

# ---- group: building heights
number_slider_5 = Slider(0.1, range=0.1..100)
number_slider_6 = Slider(50, range=1..100)
number_slider_7 = Slider(25, range=1..100)
number_slider_8 = Slider(80, range=1..100)

# ---- group: randam seed for context
# 0, 10, 20, 50
number_slider_9 = Slider(10498, range=0..20000)

# ---- group: heightListID
# 1, 3
number_slider_10 = Slider(1, range=0..3)

# ----
# Predict
toggle = BooleanToggle(False)  # disabled
panel_2 = Panel("C:\Users\RYAN\Documents\GitHub\Realtime_Sim\Python\predictWithLR_YZ.py")  # disabled
number_slider_11 = Slider(5465, range=0..5465)
# data1: 0 to 5465
# data2: 1 to 4500
number_slider_12 = Slider(4500, range=1..4500)
timer = Timer(TimerInterval=500, Target=file)
merge = Merge(Data1=number_slider_5, Data2=number_slider_7, Data3=number_slider_6, Data4=number_slider_8)
int = Integer(number_slider_10)
int_2 = Integer(number_slider_9)
int_3 = Integer(int_2)
txt = Text(flatten(int_3))
txt_2 = Text(flatten("111"))
recgrid = Rectangular(Plane=PlaneXY(0, 0, 0), SizeX=number_slider_3, SizeY=number_slider_3, ExtentX=number_slider, ExtentY=number_slider_2)  # -> Cells, Points
item = ListItem(List=merge, Index=int, Wrap=False)
num = Number(item)
txt_3 = Text(flatten(num))

# ---- group: prediction.txt
file = ReadFile(File=panel, PerLineParse=True)

# ----
end = EndPoints(Curve=recgrid.Cells)  # -> Start, End
pshift = ShiftPaths(Data=end.Start, Offset=-1)
lng = ListLength(List=pshift)
eval = Evaluate(F="int((x+1)/2)", x=lng)
subtraction = Subtraction(A=eval, B=2)
split = TextSplit(Text=file, Separators=",")
dom = ConstructDomain(DomainStart=0, DomainEnd=subtraction)
subtraction_2 = Subtraction(A=lng, B=1)
lng_2 = ListLength(List=merge)
num_2 = Number(split)
addition = Addition(A=subtraction, B=1)
subset = SubList(List=pshift, Domain=dom, Wrap=False)  # -> List, Index
dom_2 = ConstructDomain(DomainStart=eval, DomainEnd=subtraction_2)
subtraction_3 = Subtraction(A=lng_2, B=1)
item_2 = ListItem(List=pshift, Index=addition, Wrap=True)
panel_3 = Panel(num_2)
subset_2 = SubList(List=pshift, Domain=dom_2, Wrap=False)  # -> List, Index
dom_3 = ConstructDomain(DomainStart=0, DomainEnd=subtraction_3)
merge_2 = Merge(Data1=subset.List, Data2=subset_2.List)
lng_3 = ListLength(List=merge_2)
random = Random(Range=Domain(0, 1), Number=lng_3, Seed=int_2)
graph = GraphMapper(
    random,
    x0=0,
    x1=1,
    y0=0,
    y1=1,
    container_name="Bezier",
    cpx=[0, 0.5129005909, 1, 1],
    cpy=[0, 0.00346583128, 0.3901748657, 1])
remap = RemapNumbers(Value=graph, Source=Domain(0, 1), Target=dom_3)  # -> Mapped, Clipped
number_slider_13 = Slider(300, range=0..1000)

# ---- group: starting pt (except centeral one)
pt = Point(merge_2)

# ---- group: centeral starting pt
pt_2 = Point(item_2)

# ----
int_4 = Integer(remap.Mapped)
xy = XYPlane(Origin=pt_2)
xy_2 = XYPlane(Origin=pt)
dom_4 = ConstructDomain(DomainStart=0, DomainEnd=Slider(0.1, range=0.1..100))
item_3 = ListItem(List=merge, Index=int_4, Wrap=True)
neg = Negative(Value=number_slider_13)

# ---- group: result difference
num_3 = Number(panel_3)

# ----
dom_5 = ConstructDomain(DomainStart=0, DomainEnd=number_slider_4)
dom_6 = ConstructDomain(DomainStart=0, DomainEnd=item_3)
dom_7 = ConstructDomain(DomainStart=0, DomainEnd=item)
box = DomainBox(Base=xy, X=dom_5, Y=dom_5, Z=dom_4)
bnd = Bounds(Numbers=num_3)
dom_8 = ConstructDomain(DomainStart=neg, DomainEnd=number_slider_13)
box_2 = DomainBox(Base=xy_2, X=dom_5, Y=dom_5, Z=dom_6)
box_3 = DomainBox(Base=xy, X=dom_5, Y=dom_5, Z=dom_7)
remap_2 = RemapNumbers(Value=num_3, Source=dom_8, Target=Domain(0, 1))  # -> Mapped, Clipped

# ---- group: center blank replacement
brep = Brep(box)

# ----
toggle_activate = BooleanToggle(True)
gradient = Gradient(
    LowerLimit=0,
    UpperLimit=1,
    Parameter=remap_2.Mapped,
    stops=[0: RGB(0, 128, 0), 0.5: RGB(255, 255, 0), 1: RGB(255, 0, 0)])
X = UnitX(Factor=Slider(1000, range=0..1000))
swatch = ColourSwatch(SwatchColor=RGBA(191, 191, 191, 75))
swatch_2 = ColourSwatch(SwatchColor=RGBA(171, 190, 255, 150))

# ---- group: context geometry
brep_2 = Brep(box_2)

# ---- group: center building block geometry
brep_3 = Brep(box_3)

# ----
removebreptoporbottom = RemoveBrepTopOrBottom(brep=brep_2, bool=True)
preview = CustomPreview(Geometry=removebreptoporbottom, Shader=swatch)
removebreptoporbottom_2 = RemoveBrepTopOrBottom(brep=brep_3, bool=True)
preview_2 = CustomPreview(Geometry=removebreptoporbottom_2, Shader=swatch_2)
neg_2 = Negative(Value=Slider(1000, range=0..1000))
X_2 = UnitX(Factor=neg_2)
X_3 = UnitX(Factor=neg_2)
move = Move(Geometry=brep_3, Motion=X_2)  # -> Geometry, Transform
move_2 = Move(Geometry=brep_2, Motion=X_3)  # -> Geometry, Transform
preview_3 = CustomPreview(Geometry=move.Geometry, Shader=swatch_2)
preview_4 = CustomPreview(Geometry=move_2.Geometry, Shader=swatch)
number_slider_14 = Slider(1000, range=0..1000)
X_4 = UnitX(Factor=number_slider_14)
X_5 = UnitX(Factor=number_slider_14)
move_3 = Move(Geometry=removebreptoporbottom_2, Motion=X_4)  # -> Geometry, Transform
move_4 = Move(Geometry=removebreptoporbottom, Motion=X_5)  # -> Geometry, Transform
preview_5 = CustomPreview(Geometry=move_3.Geometry, Shader=swatch_2)
preview_6 = CustomPreview(Geometry=move_4.Geometry, Shader=swatch)

# ---- group: node base srf
# Nodes
brep_4 = Brep([brep_2, brep_3])

# ----
unit_width = Slider(5, range=0..10)
unit_height = Slider(5, range=0..10)

unit_width_2 = Slider(1.5, range=0..10)
unit_height_2 = Slider(4.2, range=0..10)

extractbreptoporbottom = ExtractBrepTopOrBottom(brep=brep_4, bool=True)
debrep = DeconstructBrep(Brep=brep_4)  # -> Faces, Edges, Vertices
srf = Surface(reparameterize(flatten(extractbreptoporbottom)))
num_4 = Number(unit_width)
num_5 = Number(unit_height)

# ---- group: glass srf
srf_2 = Surface(reparameterize(graft(srf)))

# ----
dim = Dimensions(Surface=srf_2)  # -> UDimension, VDimension
area = Area(Geometry=srf)  # -> Area, Centroid
division = Division(A=dim.VDimension, B=num_5)
division_2 = Division(A=dim.UDimension, B=num_4)
divide = DivideDomain²(Domain=srf_2, UCount=division_2, VCount=division)
pdecon = Deconstruct(Point=area.Centroid)  # -> XComponent, YComponent, ZComponent
subsrf = Isotrim(Surface=srf_2, Domain=divide)

# ---- group: input building height
num_6 = Number(pdecon.ZComponent)

# ---- group: result geo
srf_3 = Surface(reparameterize(flatten(subsrf)))

# ----
move_5 = Move(Geometry=srf_3, Motion=X)  # -> Geometry, Transform

# ---- group: result
preview_7 = CustomPreview(Geometry=move_5.Geometry, Shader=gradient)

# ----
join = BrepJoin(Breps=flatten(brep_4))  # -> Breps, Closed
area_2 = Area(Geometry=srf_3)  # -> Area, Centroid
nodes_offset_out = Slider(0.1, range=0..1)
mesh = MeshBrep(
    Brep=join.Breps,
    Settings={GridMaxCount=0, GridMinCount=16, JaggedSeams=False, MaxEdgeLength=0, MinEdgeLength=0.0001, MinTolerance=0, Refine=True, RefineAngle=0, RelativeTolerance=0.65, SimplePlanes=True, Tolerance=0})
mjoin = MeshJoin(Meshes=mesh)
meshcp = MeshClosestPoint(Point=area_2.Centroid, Mesh=mjoin)  # -> Point, Index, Parameter
meval = MeshEval(Mesh=mjoin, Parameter=meshcp.Parameter)  # -> Point, Normal, Colour
amp = Amplitude(Vector=meval.Normal, Amplitude=nodes_offset_out)
move_6 = Move(Geometry=area_2.Centroid, Motion=amp)  # -> Geometry, Transform

# ---- group: testing nodes
pt_3 = Point(move_6.Geometry)

# Data Export
pt_4 = Point(pt_3)

# ----
pdecon_2 = Deconstruct(Point=pt_4)  # -> XComponent, YComponent, ZComponent
subtraction_4 = Subtraction(A=pdecon_2.ZComponent, B=0.1)
merge_3 = Merge(Data1=graft(pdecon_2.XComponent), Data2=graft(pdecon_2.YComponent), Data3=graft(subtraction_4))
join_2 = TextJoin(Text=merge_3, Join=",")
pshift_2 = ShiftPaths(Data=join_2, Offset=-1)
panel_4 = Panel(pshift_2)
txt_4 = Text(flatten(panel_4))
merge_4 = Merge(
    Data1="[start]central building height",
    Data2=txt_3,
    Data3="[end]central building height",
    Data4="[start]random seed number",
    Data5=txt,
    Data6="[end]random seed number",
    Data7="[start]input node coordination",
    Data8=txt_4,
    Data9="[end]input node coordination",
    Data10="[start]node reads difference",
    Data11=txt_2,
    Data12="[end]node reads difference")

# ---- group: data to export
panel_5 = Panel(merge_4)

# ---- group: write txt file
vb = VBScript(
    filePath="C:\Users\RYAN\Documents\GitHub\Realtime_Sim\Data\Xtest.txt",
    data=panel_5,
    append=False,
    activate=toggle_activate)  # -> out, A; inputs data: list
# ---------- vb: VB ----------
    'Code by Victor Leung @ www.dreamationworks.com
    If activate Then

      Dim i As Integer
      Dim aryText(4) As String

      aryText(0) = "Mary WriteLine"
      aryText(1) = "Had"
      aryText(2) = "Another"
      aryText(3) = "Little"
      aryText(4) = "One"

      ' the data is appended to the file. If file doesnt exist, a new file is created
      Dim objWriter As New System.IO.StreamWriter(filePath, append)

      For i = 0 To data.Count - 1
        objWriter.WriteLine(data(i))
      Next

      objWriter.Close()

    End If

    If clearFile Then
      Dim objWriter As New System.IO.StreamWriter(filePath, False)
      objWriter.Close()
    End If
# ---------- end vb ----------

# ---- group: Call Predict Python Script
python = PythonScript(active=toggle, trigger=vb.A, pathPyPredict=panel_2)  # -> out, predictionPath; disabled
# ---------- python: Python ----------
"""
Realtime Simulator

written by Yan "Ryan" Zhang <ryanz@mit.edu>
for MIT Media Lab, Changing Place Group, CityScope Project
March.7th.2016
"""

#str01 = "x:"+str(x)+"; y:"+str(y)+"; z:"+str(z)
#print str01

if active: 
    from subprocess import call
    #call(["python", "C:\\Users\\RYAN\\Documents\\GitHub\\Realtime_Simulator\\Python\\\predictWithLR_YZ.py"])
    #print(pathPyPredict)
    call(["pythonw", pathPyPredict])
    # the print in called python script will not work
    predictionPath = "C:\Users\RYAN\Documents\GitHub\Realtime_Sim\Data\prediction.txt"


"""
call os in gh, and pass input parameters, 
and use subprocess to call a python script with arguement, 
output to a file and have gh read csv. 
"""
# ---------- end python ----------

# ----
panel_6 = Panel(python.predictionPath)  # disabled

# ==== cluster RemoveBrepTopOrBottom
brep = ClusterInput()
bool = ClusterInput()
brep_2 = Brep(brep)
bool_2 = Boolean(bool)
num = Number(bool_2)
debrep = DeconstructBrep(Brep=brep_2)  # -> Faces, Edges, Vertices
subtraction = Subtraction(A=num, B=0.5)
multiplication = Multiplication(A=subtraction, B=2)
Z = UnitZ(Factor=multiplication)
area = Area(Geometry=debrep.Faces)  # -> Area, Centroid
srf_cp = SurfaceClosestPoint(Point=area.Centroid, Surface=debrep.Faces)  # -> Point, UVPoint, Distance
evalsrf = EvaluateSurface(Surface=debrep.Faces, Point=srf_cp.UVPoint)  # -> Point, Normal, Frame
angle = Angle(VectorA=evalsrf.Normal, VectorB=Z)  # -> Angle, Reflex
equals = Equality(FirstNumber=angle.Angle, SecondNumber=0)  # -> Equality, Inequality
dispatch = Dispatch(List=debrep.Faces, DispatchPattern=equals.Inequality)  # -> ListA, ListB
srf = Surface(dispatch.ListA)
join = BrepJoin(Breps=srf)  # -> Breps, Closed
pshift = ShiftPaths(Data=join.Breps, Offset=-1)
brep_3 = Brep(pshift)
brep_4 = ClusterOutput(brep_3)

# ==== cluster ExtractBrepTopOrBottom
brep = ClusterInput()
bool = ClusterInput()
brep_2 = Brep(brep)
bool_2 = Boolean(bool)
num = Number(bool_2)
debrep = DeconstructBrep(Brep=brep_2)  # -> Faces, Edges, Vertices
subtraction = Subtraction(A=num, B=0.5)
multiplication = Multiplication(A=subtraction, B=2)
Z = UnitZ(Factor=multiplication)
area = Area(Geometry=debrep.Faces)  # -> Area, Centroid
srf_cp = SurfaceClosestPoint(Point=area.Centroid, Surface=debrep.Faces)  # -> Point, UVPoint, Distance
evalsrf = EvaluateSurface(Surface=debrep.Faces, Point=srf_cp.UVPoint)  # -> Point, Normal, Frame
angle = Angle(VectorA=evalsrf.Normal, VectorB=Z)  # -> Angle, Reflex
equals = Equality(FirstNumber=angle.Angle, SecondNumber=0)  # -> Equality, Inequality
dispatch = Dispatch(List=debrep.Faces, DispatchPattern=equals.Equality)  # -> ListA, ListB
srf = Surface(dispatch.ListA)
srf_2 = ClusterOutput(srf)
