# Grasshopper definition 160222_Projection Mapping.gh (Grasshopper 0.9.76)

# ---- group: grid size
number_slider = Slider(16, range=1..19)
number_slider_2 = Slider(16, range=1..19)

# ---- group: grid dimension
number_slider_3 = Slider(34.331, range=1..100)

# ---- group: building dimension
number_slider_4 = Slider(32.578, range=1..100)

# ---- group: building heights
number_slider_5 = Slider(0.1, range=0.1..100)
number_slider_6 = Slider(25, range=1..100)
number_slider_7 = Slider(50, range=1..100)
number_slider_8 = Slider(80, range=1..100)

# ---- group: heightListID
# 1, 3
number_slider_9 = Slider(1, range=0..3)

# ---- group: randam seed for context
# 0, 10, 20, 50
number_slider_10 = Slider(0, range=0..20000)

# ----
# Realtime Simulator
# 
# by Yan "Ryan" Zhang <ryanz@mit.edu>
# for MIT Media Lab, Changing Place Group, CityScope Project
# March.7th.2016
# Parametric Modelling
crv = Curve([<curve referenced from the Rhino model> x31])
number_slider_11 = Slider(5465, range=0..5465)
# data1: 0 to 5465
# data2: 1 to 4500
number_slider_12 = Slider(4500, range=1..4500)
bbox = BoundingBox(Content=crv, Plane=PlaneXY(0, 0, 0), UnionBox=True)  # -> Box, Box_2
num = Number(number_slider_3)
merge = Merge(Data1=number_slider_5, Data2=number_slider_6, Data3=number_slider_7, Data4=number_slider_8)
box_corners = BoxCorners(Box=bbox.Box)  # -> CornerA, CornerB, CornerC, CornerD, CornerE, CornerF, CornerG, CornerH
int = Integer(number_slider_9)
int_2 = Integer(number_slider_10)
xy = XYPlane(Origin=box_corners.CornerA)
division = Division(A=merge, B=Slider(2, range=0..10))
dist = Distance(PointA=box_corners.CornerA, PointB=box_corners.CornerB)
dist_2 = Distance(PointA=box_corners.CornerA, PointB=box_corners.CornerD)
num_2 = Number(division)
item = ListItem(List=num_2, Index=int, Wrap=False)
division_2 = Division(A=dist, B=number_slider)
division_3 = Division(A=dist_2, B=number_slider_2)
recgrid = Rectangular(Plane=xy, SizeX=division_2, SizeY=division_3, ExtentX=number_slider, ExtentY=number_slider_2)  # -> Cells, Points
end = EndPoints(Curve=recgrid.Cells)  # -> Start, End
pshift = ShiftPaths(Data=end.Start, Offset=-1)
lng = ListLength(List=pshift)
eval = Evaluate(F="int((x+1)/2)", x=lng)
subtraction = Subtraction(A=eval, B=2)
dom = ConstructDomain(DomainStart=0, DomainEnd=subtraction)
subtraction_2 = Subtraction(A=lng, B=1)
multiplication = Multiplication(A=division_2, B=number_slider_4)
lng_2 = ListLength(List=num_2)
addition = Addition(A=subtraction, B=1)
subset = SubList(List=pshift, Domain=dom, Wrap=False)  # -> List, Index
dom_2 = ConstructDomain(DomainStart=eval, DomainEnd=subtraction_2)
division_4 = Division(A=multiplication, B=number_slider_3)
num_3 = Number(division_4)
subtraction_3 = Subtraction(A=lng_2, B=1)
item_2 = ListItem(List=pshift, Index=addition, Wrap=True)
subset_2 = SubList(List=pshift, Domain=dom_2, Wrap=False)  # -> List, Index
dom_3 = ConstructDomain(DomainStart=0, DomainEnd=subtraction_3)
merge_2 = Merge(Data1=subset.List, Data2=subset_2.List)
lng_3 = ListLength(List=merge_2)
random = Random(Range=Domain(0, 1), Number=lng_3, Seed=int_2)
graph = GraphMapper(
    random,
    x0=0,
    x1=1,
    y0=0,
    y1=1,
    container_name="Bezier",
    cpx=[0, 0.5129005909, 1, 1],
    cpy=[0, 0.00346583128, 0.3901748657, 1])
remap = RemapNumbers(Value=graph, Source=Domain(0, 1), Target=dom_3)  # -> Mapped, Clipped

# ---- group: starting pt (except centeral one)
pt = Point(merge_2)

# ---- group: centeral starting pt
pt_2 = Point(item_2)

# ----
int_3 = Integer(remap.Mapped)
xy_2 = XYPlane(Origin=pt_2)
xy_3 = XYPlane(Origin=pt)
dom_4 = ConstructDomain(DomainStart=0, DomainEnd=Slider(0.1, range=0.1..100))
item_3 = ListItem(List=num_2, Index=int_3, Wrap=True)
dom_5 = ConstructDomain(DomainStart=0, DomainEnd=num_3)
dom_6 = ConstructDomain(DomainStart=0, DomainEnd=item_3)
dom_7 = ConstructDomain(DomainStart=0, DomainEnd=item)
box = DomainBox(Base=xy_2, X=dom_5, Y=dom_5, Z=dom_4)
box_2 = DomainBox(Base=xy_3, X=dom_5, Y=dom_5, Z=dom_6)
box_3 = DomainBox(Base=xy_2, X=dom_5, Y=dom_5, Z=dom_7)

# ---- group: center blank replacement
brep = Brep(box)
