# Grasshopper definition 160224_Python UDP test 1.gh (Grasshopper 0.9.76)
# plug-ins: Python Interpreter

python = PythonScript(active=Toggle(True))  # -> out, a
# ---------- python: Python ----------
import socket

UDP_IP = "127.0.0.1"
UDP_PORT = 7701

sock = socket.socket(socket.AF_INET, socket.SOCK_DGRAM)
#sock.setsockopt(SOL_SOCKET, SO_REUSEADDR, 1)
sock.bind((UDP_IP, UDP_PORT))

blnRunned = False
while active and not blnRunned:
    data, addr = sock.recvfrom(1024) # buffer size is 1024 bytes
    print "received message:", data
    blnRunned = True
# ---------- end python ----------
