# Grasshopper definition 160225_Python UDP test 2_working but slow.gh (Grasshopper 0.9.76)
# plug-ins: Python Interpreter

timer = Timer(TimerInterval=500, Target=python)  # disabled
python = PythonScript()  # -> out, a
# ---------- python: Python ----------
import socket

UDP_IP = "RYAN_YOGA_2_PRO"
UDP_PORT = 7001
#UDP_IP = "RYAN_DELL_XPS_WIN8"
#UDP_PORT = 7002

sock = socket.socket(socket.AF_INET, socket.SOCK_DGRAM)
sock.bind((UDP_IP, UDP_PORT))

"""
while active:
    data, addr = sock.recvfrom(9999) # buffer size is 1024 bytes
    print "received message:", data
"""
data, addr = sock.recvfrom(9999) # buffer size is 1024 bytes
print "Message received!"
a = data

sock.close()
# ---------- end python ----------
panel = Panel(python.out)
panel_2 = Panel(python.a)
