# Grasshopper definition 160225_gHowl UDP test 1_working.gh (Grasshopper 0.9.76)
# plug-ins: gHowl

# ---- group: machine name doesn't work here
panel = Panel("\"RYAN_YOGA_2_PRO\"")

# ---- group: get ip address and disable, very slow
netsource = NetworkSource()  # -> NetworkAdapterIsUp, AdapterProperties, LocalIpAddress; disabled

# ----
panel_2 = Panel("7001")
udp = UDPSender(Port=6001, Pattern=0)  # disabled
txt = Text("192.168.126.1")
udp_2 = UDPReceiver(Address="127.0.0.1", Port="6111", Pattern="0")  # -> Info, Data
panel_3 = Panel(txt)
panel_4 = Panel(udp_2.Info)
panel_5 = Panel(udp_2.Data)
