# Grasshopper definition 160301_sticky_global_variable_function.gh (Grasshopper 0.9.76)
# plug-ins: Python Interpreter

python = PythonScript()  # -> out, a
# ---------- python: Python ----------
import scriptcontext as sc

sc.sticky["data"]=1


def test():
    # compute
    print "hello"
    
sc.sticky["test_function"]=test
# ---------- end python ----------
file = ReadFile(PerLineParse=True)
python_2 = PythonScript()  # -> out, a
# ---------- python_2: Python ----------
import scriptcontext as sc

print sc.sticky["data"]

a = sc.sticky["test_function"]

a()
# ---------- end python_2 ----------
panel = Panel(python_2.out)
num = Number(Slider(12, range=0..100))
