# Grasshopper definition 160324_Realtime Simulator_Training Set Generator.gh (Grasshopper 0.9.76)
# plug-ins: DIVA.ForGrasshopper

# ---- group: grid size
number_slider = Slider(5, range=1..19)
number_slider_2 = Slider(5, range=1..19)

# ---- group: grid dimension
# Realtime Simulator
# 
# by Yan "Ryan" Zhang <ryanz@mit.edu>
# for MIT Media Lab, Changing Place Group, CityScope Project
# March.7th.2016
# Parametric Modelling
number_slider_3 = Slider(34.331, range=1..100)

# ---- group: building dimension
number_slider_4 = Slider(32.578, range=1..100)

# ---- group: building heights
number_slider_5 = Slider(0.1, range=0.1..100)
series = Series(Start=10, Step=10, Count=8)

# ---- group: randam seed for context
# 0, 10, 20, 50
number_slider_6 = Slider(9999, range=0..9999)

# ---- group: glass
brep = Brep()
M = Material(Geometry=brep, Geometry_2=brep, Material="GenericCeiling_80")  # -> GeometryWithMaterialAssigned, GeometryWithMaterialAssigned_2

# ---- group: ground
brep_2 = Brep()
M_2 = Material(Geometry=brep_2, Geometry_2=brep_2, Material="GenericCeiling_80")  # -> GeometryWithMaterialAssigned, GeometryWithMaterialAssigned_2

# ----
unit_width = Slider(5, range=0..10)
unit_height = Slider(5, range=0..10)

# ---- group: can not be button!
# Analysis (with Central Building)
toggle = BooleanToggle(True)

# ----
unit_width_2 = Slider(1.5, range=0..10)
unit_height_2 = Slider(4.2, range=0..10)

# ---- group: glass
brep_3 = Brep()
M_3 = Material(Geometry=brep_3, Geometry_2=brep_3, Material="GenericCeiling_80")  # -> GeometryWithMaterialAssigned, GeometryWithMaterialAssigned_2

# ---- group: ground
brep_4 = Brep()
M_4 = Material(Geometry=brep_4, Geometry_2=brep_4, Material="GenericCeiling_80")  # -> GeometryWithMaterialAssigned, GeometryWithMaterialAssigned_2

# ----
unit_width_3 = Slider(5, range=0..10)
unit_height_3 = Slider(5, range=0..10)

# ---- group: can not be button!
# Analysis (without Central Building)
toggle_2 = BooleanToggle(True)

# ----
unit_width_4 = Slider(1.5, range=0..10)
unit_height_4 = Slider(4.2, range=0..10)

int = Integer(number_slider_6)
merge = Merge(Data1=flatten(number_slider_5), Data2=flatten(series))
recgrid = Rectangular(Plane=PlaneXY(0, 0, 0), SizeX=number_slider_3, SizeY=number_slider_3, ExtentX=number_slider, ExtentY=number_slider_2)  # -> Cells, Points
num = Number(unit_width)
num_2 = Number(unit_height)
num_3 = Number(unit_width_3)
num_4 = Number(unit_height_3)

# ---- group: center, exclude 0.10
num_5 = Number(series)

# ---- group: surrounding, include 0.10
num_6 = Number(merge)

# ----
end = EndPoints(Curve=recgrid.Cells)  # -> Start, End
# here is for center height shouldn't be 0.1;
# and shouldn't be the same random as any of the surroundings
lng = ListLength(List=num_6)
lng_2 = ListLength(List=num_5)
lng_3 = ListLength(List=flatten(recgrid.Cells))
pshift = ShiftPaths(Data=end.Start, Offset=-1)
lng_4 = ListLength(List=pshift)
eval = Evaluate(F="int((x+1)/2)", x=lng_4)
subtraction = Subtraction(A=eval, B=2)
subtraction_2 = Subtraction(A=lng_2, B=1)
subtraction_3 = Subtraction(A=lng, B=1)
dom = ConstructDomain(DomainStart=0, DomainEnd=subtraction)
random = Random(Range=Domain(0, 1), Number=lng_3, Seed=int)
subtraction_4 = Subtraction(A=lng_4, B=1)
dom_2 = ConstructDomain(DomainStart=0, DomainEnd=subtraction_2)
dom_3 = ConstructDomain(DomainStart=0, DomainEnd=subtraction_3)
addition = Addition(A=subtraction, B=1)
subset = SubList(List=pshift, Domain=dom, Wrap=False)  # -> List, Index
graph = GraphMapper(random, x0=0, x1=1, y0=0, y1=1, container_name="Bezier", cpx=[0, 0.4946732819, 1, 1], cpy=[0, 0, 0.5063705444, 1])
dom_4 = ConstructDomain(DomainStart=eval, DomainEnd=subtraction_4)
item = ListItem(List=pshift, Index=addition, Wrap=True)
subset_2 = SubList(List=pshift, Domain=dom_4, Wrap=False)  # -> List, Index
remap = RemapNumbers(Value=graph, Source=Domain(0, 1), Target=dom_2)  # -> Mapped, Clipped
lng_5 = ListLength(List=remap.Mapped)
subtraction_5 = Subtraction(A=lng_5, B=1)
merge_2 = Merge(Data1=subset.List, Data2=subset_2.List)
lng_6 = ListLength(List=flatten(merge_2))
random_2 = Random(Range=Domain(0, 1), Number=lng_6, Seed=int)
graph_2 = GraphMapper(random_2, x0=0, x1=1, y0=0, y1=1, container_name="Bezier", cpx=[0, 0.4946732819, 1, 1], cpy=[0, 0, 0.5063705444, 1])
remap_2 = RemapNumbers(Value=graph_2, Source=Domain(0, 1), Target=dom_3)  # -> Mapped, Clipped
int_2 = Integer(remap_2.Mapped)
split = SplitList(List=remap.Mapped, Index=subtraction_5)  # -> ListA, ListB
nodes_offset_out = Slider(0.1, range=0..1)

# ---- group: starting pt (except centeral one)
pt = Point(merge_2)

# ---- group: centeral starting pt
pt_2 = Point(item)

# ----
int_3 = Integer(split.ListB)
nodes_offset_out_2 = Slider(0.1, range=0..1)
xy = XYPlane(Origin=pt_2)
X = UnitX(Factor=Slider(1000, range=0..1000))
item_2 = ListItem(List=num_5, Index=int_3, Wrap=True)
xy_2 = XYPlane(Origin=pt)
item_3 = ListItem(List=num_6, Index=int_2, Wrap=True)
dom_5 = ConstructDomain(DomainStart=0, DomainEnd=Slider(0.1, range=0.1..100))
dom_6 = ConstructDomain(DomainStart=0, DomainEnd=number_slider_4)
dom_7 = ConstructDomain(DomainStart=0, DomainEnd=item_2)
dom_8 = ConstructDomain(DomainStart=0, DomainEnd=item_3)
box = DomainBox(Base=xy, X=dom_6, Y=dom_6, Z=dom_5)
box_2 = DomainBox(Base=xy_2, X=dom_6, Y=dom_6, Z=dom_8)
box_3 = DomainBox(Base=xy, X=dom_6, Y=dom_6, Z=dom_7)
graft = GraftTree(Tree=box, IncludeEmptyLists=True, IncludeNullItems=True)

# ---- group: center blank replacement
brep_5 = Brep(graft)

# ----
swatch = ColourSwatch(SwatchColor=RGBA(191, 191, 191, 75))
swatch_2 = ColourSwatch(SwatchColor=RGBA(171, 190, 255, 150))

# ---- group: context geometry
brep_6 = Brep(box_2)

# ----
merge_3 = Merge(Data1=flatten(brep_5), Data2=flatten(brep_6))
merge_4 = Merge(Data1=flatten(brep_5), Data2=flatten(brep_6))

# ---- group: slab
brep_7 = Brep(merge_3)
M_5 = Material(Geometry=brep_7, Geometry_2=brep_7, Material="GenericCeiling_80")  # -> GeometryWithMaterialAssigned, GeometryWithMaterialAssigned_2

# ---- group: node base srf
brep_8 = Brep(merge_4)

# ----
extractbreptoporbottom = ExtractBrepTopOrBottom(brep=brep_8, bool=True)
debrep = DeconstructBrep(Brep=brep_8)  # -> Faces, Edges, Vertices
srf = Surface(reparameterize(flatten(extractbreptoporbottom)))

# ---- group: glass srf
srf_2 = Surface(reparameterize(graft(srf)))

# ----
dim = Dimensions(Surface=srf_2)  # -> UDimension, VDimension
division = Division(A=dim.VDimension, B=num_4)
division_2 = Division(A=dim.UDimension, B=num_3)
divide = DivideDomain²(Domain=srf_2, UCount=division_2, VCount=division)
subsrf = Isotrim(Surface=srf_2, Domain=divide)

# ---- group: result geo
srf_3 = Surface(reparameterize(flatten(subsrf)))

# ----
join = BrepJoin(Breps=flatten(brep_8))  # -> Breps, Closed
area = Area(Geometry=srf_3)  # -> Area, Centroid
mesh = MeshBrep(
    Brep=join.Breps,
    Settings={GridMaxCount=0, GridMinCount=16, JaggedSeams=False, MaxEdgeLength=0, MinEdgeLength=0.0001, MinTolerance=0, Refine=True, RefineAngle=0, RelativeTolerance=0.65, SimplePlanes=True, Tolerance=0})
mjoin = MeshJoin(Meshes=mesh)
meshcp = MeshClosestPoint(Point=area.Centroid, Mesh=mjoin)  # -> Point, Index, Parameter
move = Move(Geometry=srf_3, Motion=X)  # -> Geometry, Transform
meval = MeshEval(Mesh=mjoin, Parameter=meshcp.Parameter)  # -> Point, Normal, Colour
amp = Amplitude(Vector=meval.Normal, Amplitude=nodes_offset_out_2)

# ---- group: optional
# default: -ab 2 -ad 1000 -as 20 -ar 300 -aa 0.1
# low1: -ab 2 -ad 600 -as 12 -ar 200 -aa 0.1
# low2: -ab 2 -ad 450 -as 9 -ar 150 -aa 0.1
# low3: -ab 2 -ad 300 -as 6 -ar 100 -aa 0.1
vec = Vector(amp)

# ----
move_2 = Move(Geometry=area.Centroid, Motion=amp)  # -> Geometry, Transform

# ---- group: testing nodes
pt_3 = Point(move_2.Geometry)

# ----
diva_daylight = DIVADaylightAnalysisForGH(
    ProjectName="PROJECT_NAME",
    GeometryWithRadianceMaterialReference=[M_3.GeometryWithMaterialAssigned_2, M_5.GeometryWithMaterialAssigned_2, M_4.GeometryWithMaterialAssigned_2],
    AnalysisNodes=pt_3,
    WriteOnly=False,
    RunSimulation=toggle_2,
    ProjectName_2="PROJECT_NAME",
    GeometryWithRadianceMaterialReference_2=[M_3.GeometryWithMaterialAssigned_2, M_5.GeometryWithMaterialAssigned_2, M_4.GeometryWithMaterialAssigned_2],
    AnalysisNodes_2=pt_3,
    WriteOnly_2=False,
    RunSimulation_2=toggle_2,
    Climate_Occ=0,
    Climate_RadParam="-ab 2 -ad 1000 -as 20 -ar 300 -aa 0.1",
    DF_RadParam="-ab 2 -ad 1000 -as 20 -ar 300 -aa 0.1",
    DimIrr=200,
    DirIrr=800,
    Ill_RadParam="-ab 2 -ad 1000 -as 20 -ar 300 -aa 0.1",
    Insol_CustomDates=False,
    Insol_EndDay=30,
    Insol_EndMonth=11,
    Insol_RadParam="-ab 2 -ad 1000 -as 20 -ar 300 -aa 0.1",
    Insol_StartDay=0,
    Insol_StartMonth=0,
    Insol_Vis_RadParam="-ab 2 -ad 1000 -as 20 -ar 300 -aa 0.1",
    InsolationPeriod=0,
    Irr_FC_legend_max="auto",
    Light_Operation=3,
    Lighting_Param="-W 250.0 -Set 300 -Loss 20 -Standby 0.0",
    Location="USA_MA_Boston-Logan.Intl.AP.725090_TMY3.epw",
    Lum_FC_legend_max="auto",
    MDH_Input=False,
    MinIll=300,
    OutputStates=True,
    Quality=0,
    Rhino_Include=False,
    SimulationType=0,
    SkyCond=0,
    StartDay=20,
    StartHour=12,
    StartMonth=5,
    Vis_RadParam="-ps 8 -pt .15 -pj .6 -dj 0 -ds .5 -dt .5 -dc .25 -dr 0 -dp 64 -st .85 -ab 2 -aa .25 -ar 16 -ad 512 -as 128 -lr 4 -lw .05 -av 0 0 0",
    X_Resolution=600,
    Y_Resolution=400)  # -> OutputMessage, MetricSolarIrradiation, OutputMessage_2, MetricSolarIrradiation_2

# ---- group: result with ground
num_7 = Number(diva_daylight.MetricSolarIrradiation_2)

# ---- group: Internalise to record the result
num_8 = Number(diva_daylight.MetricSolarIrradiation_2)

# ----
bnd = Bounds(Numbers=num_7)

# ---- group: center building block geometry
brep_9 = Brep(box_3)

# ----
merge_5 = Merge(Data1=flatten(brep_9), Data2=flatten(brep_6))
merge_6 = Merge(Data1=flatten(brep_9), Data2=flatten(brep_6))

# ---- group: slab
brep_10 = Brep(merge_5)
M_6 = Material(Geometry=brep_10, Geometry_2=brep_10, Material="GenericCeiling_80")  # -> GeometryWithMaterialAssigned, GeometryWithMaterialAssigned_2

# ---- group: node base srf
brep_11 = Brep(merge_6)

# ----
extractbreptoporbottom_2 = ExtractBrepTopOrBottom(brep=brep_11, bool=True)
debrep_2 = DeconstructBrep(Brep=brep_11)  # -> Faces, Edges, Vertices
srf_4 = Surface(reparameterize(flatten(extractbreptoporbottom_2)))

# ---- group: glass srf
srf_5 = Surface(reparameterize(graft(srf_4)))

# ----
dim_2 = Dimensions(Surface=srf_5)  # -> UDimension, VDimension
area_2 = Area(Geometry=srf_4)  # -> Area, Centroid
division_3 = Division(A=dim_2.VDimension, B=num_2)
division_4 = Division(A=dim_2.UDimension, B=num)
divide_2 = DivideDomain²(Domain=srf_5, UCount=division_4, VCount=division_3)
pdecon = Deconstruct(Point=area_2.Centroid)  # -> XComponent, YComponent, ZComponent
subsrf_2 = Isotrim(Surface=srf_5, Domain=divide_2)

# ---- group: input building height
num_9 = Number(pdecon.ZComponent)

# ---- group: result geo
srf_6 = Surface(reparameterize(flatten(subsrf_2)))

# ----
join_2 = BrepJoin(Breps=flatten(brep_11))  # -> Breps, Closed
area_3 = Area(Geometry=srf_6)  # -> Area, Centroid
mesh_2 = MeshBrep(
    Brep=join_2.Breps,
    Settings={GridMaxCount=0, GridMinCount=16, JaggedSeams=False, MaxEdgeLength=0, MinEdgeLength=0.0001, MinTolerance=0, Refine=True, RefineAngle=0, RelativeTolerance=0.65, SimplePlanes=True, Tolerance=0})
mjoin_2 = MeshJoin(Meshes=mesh_2)
meshcp_2 = MeshClosestPoint(Point=area_3.Centroid, Mesh=mjoin_2)  # -> Point, Index, Parameter
meval_2 = MeshEval(Mesh=mjoin_2, Parameter=meshcp_2.Parameter)  # -> Point, Normal, Colour
amp_2 = Amplitude(Vector=meval_2.Normal, Amplitude=nodes_offset_out)

# ---- group: optional
# default: -ab 2 -ad 1000 -as 20 -ar 300 -aa 0.1
# low1: -ab 2 -ad 600 -as 12 -ar 200 -aa 0.1
# low2: -ab 2 -ad 450 -as 9 -ar 150 -aa 0.1
# low3: -ab 2 -ad 300 -as 6 -ar 100 -aa 0.1
vec_2 = Vector(amp_2)

# ----
move_3 = Move(Geometry=area_3.Centroid, Motion=amp_2)  # -> Geometry, Transform

# ---- group: testing nodes
pt_4 = Point(move_3.Geometry)

# ----
diva_daylight_2 = DIVADaylightAnalysisForGH(
    ProjectName="PROJECT_NAME",
    GeometryWithRadianceMaterialReference=[M.GeometryWithMaterialAssigned_2, M_6.GeometryWithMaterialAssigned_2, M_2.GeometryWithMaterialAssigned_2],
    AnalysisNodes=pt_4,
    WriteOnly=False,
    RunSimulation=toggle,
    ProjectName_2="PROJECT_NAME",
    GeometryWithRadianceMaterialReference_2=[M.GeometryWithMaterialAssigned_2, M_6.GeometryWithMaterialAssigned_2, M_2.GeometryWithMaterialAssigned_2],
    AnalysisNodes_2=pt_4,
    WriteOnly_2=False,
    RunSimulation_2=toggle,
    Climate_Occ=0,
    Climate_RadParam="-ab 2 -ad 1000 -as 20 -ar 300 -aa 0.1",
    DF_RadParam="-ab 2 -ad 1000 -as 20 -ar 300 -aa 0.1",
    DimIrr=200,
    DirIrr=800,
    Ill_RadParam="-ab 2 -ad 1000 -as 20 -ar 300 -aa 0.1",
    Insol_CustomDates=False,
    Insol_EndDay=30,
    Insol_EndMonth=11,
    Insol_RadParam="-ab 2 -ad 1000 -as 20 -ar 300 -aa 0.1",
    Insol_StartDay=0,
    Insol_StartMonth=0,
    Insol_Vis_RadParam="-ab 2 -ad 1000 -as 20 -ar 300 -aa 0.1",
    InsolationPeriod=0,
    Irr_FC_legend_max="auto",
    Light_Operation=3,
    Lighting_Param="-W 250.0 -Set 300 -Loss 20 -Standby 0.0",
    Location="USA_MA_Boston-Logan.Intl.AP.725090_TMY3.epw",
    Lum_FC_legend_max="auto",
    MDH_Input=False,
    MinIll=300,
    OutputStates=True,
    Quality=0,
    Rhino_Include=False,
    SimulationType=0,
    SkyCond=0,
    StartDay=20,
    StartHour=12,
    StartMonth=5,
    Vis_RadParam="-ps 8 -pt .15 -pj .6 -dj 0 -ds .5 -dt .5 -dc .25 -dr 0 -dp 64 -st .85 -ab 2 -aa .25 -ar 16 -ad 512 -as 128 -lr 4 -lw .05 -av 0 0 0",
    X_Resolution=600,
    Y_Resolution=400)  # -> OutputMessage, MetricSolarIrradiation, OutputMessage_2, MetricSolarIrradiation_2

# ---- group: result with ground
num_10 = Number(diva_daylight_2.MetricSolarIrradiation_2)

# ---- group: Internalise to record the result
num_11 = Number(diva_daylight_2.MetricSolarIrradiation_2)

# ----
bnd_2 = Bounds(Numbers=num_10)
remap_3 = RemapNumbers(Value=num_10, Source=bnd_2, Target=Domain(0, 1))  # -> Mapped, Clipped
remap_4 = RemapNumbers(Value=num_7, Source=bnd_2, Target=Domain(0, 1))  # -> Mapped, Clipped
gradient = Gradient(
    LowerLimit=0,
    UpperLimit=1,
    Parameter=remap_3.Mapped,
    stops=[0: RGB(0, 128, 0), 0.5: RGB(255, 255, 0), 1: RGB(255, 0, 0)])
gradient_2 = Gradient(
    LowerLimit=0,
    UpperLimit=1,
    Parameter=remap_4.Mapped,
    stops=[0: RGB(0, 128, 0), 0.5: RGB(255, 255, 0), 1: RGB(255, 0, 0)])

# ---- group: result
preview = CustomPreview(Geometry=srf_6, Shader=gradient)

preview_2 = CustomPreview(Geometry=move.Geometry, Shader=gradient_2)

# ----
removebreptoporbottom = RemoveBrepTopOrBottom(brep=brep_6, bool=True)
preview_3 = CustomPreview(Geometry=removebreptoporbottom, Shader=swatch)
removebreptoporbottom_2 = RemoveBrepTopOrBottom(brep=brep_9, bool=True)
preview_4 = CustomPreview(Geometry=removebreptoporbottom_2, Shader=swatch_2)
# Analysis (difference)
subtraction_6 = Subtraction(A=num_10, B=num_7)
dom_9 = ConstructDomain(DomainStart="-500", DomainEnd="500")

# ---- group: result difference
num_12 = Number(subtraction_6)

# ---- group: node reads difference
# Data Export
panel = Panel(num_12)

# ----
neg = Negative(Value=Slider(1000, range=0..1000))
X_2 = UnitX(Factor=neg)
X_3 = UnitX(Factor=neg)
move_4 = Move(Geometry=brep_9, Motion=X_2)  # -> Geometry, Transform
move_5 = Move(Geometry=brep_6, Motion=X_3)  # -> Geometry, Transform
remap_5 = RemapNumbers(Value=num_12, Source=dom_9, Target=Domain(0, 1))  # -> Mapped, Clipped
preview_5 = CustomPreview(Geometry=move_4.Geometry, Shader=swatch_2)
preview_6 = CustomPreview(Geometry=move_5.Geometry, Shader=swatch)
gradient_3 = Gradient(
    LowerLimit=0,
    UpperLimit=1,
    Parameter=remap_5.Mapped,
    stops=[0: RGB(0, 128, 0), 0.5: RGB(255, 255, 0), 1: RGB(255, 0, 0)])
X_4 = UnitX(Factor=Slider(1000, range=0..1000))

# ---- group: testing nodes
pt_5 = Point(pt_4)

# ----
move_6 = Move(Geometry=srf_6, Motion=X_4)  # -> Geometry, Transform
pdecon_2 = Deconstruct(Point=pt_5)  # -> XComponent, YComponent, ZComponent
number_slider_7 = Slider(1000, range=0..1000)

# ---- group: result
preview_7 = CustomPreview(Geometry=move_6.Geometry, Shader=gradient_3)

# ----
num_13 = Number(item_2)
int_4 = Integer(int)
subtraction_7 = Subtraction(A=pdecon_2.ZComponent, B=0.1)
txt = Text(flatten(num_13))
txt_2 = Text(flatten(int_4))
txt_3 = Text(flatten(panel))
X_5 = UnitX(Factor=number_slider_7)
X_6 = UnitX(Factor=number_slider_7)
move_7 = Move(Geometry=removebreptoporbottom_2, Motion=X_5)  # -> Geometry, Transform
move_8 = Move(Geometry=removebreptoporbottom, Motion=X_6)  # -> Geometry, Transform
merge_7 = Merge(Data1=graft(pdecon_2.XComponent), Data2=graft(pdecon_2.YComponent), Data3=graft(subtraction_7))
preview_8 = CustomPreview(Geometry=move_7.Geometry, Shader=swatch_2)
preview_9 = CustomPreview(Geometry=move_8.Geometry, Shader=swatch)
join_3 = TextJoin(Text=merge_7, Join=",")
pshift_2 = ShiftPaths(Data=join_3, Offset=-1)
panel_2 = Panel(pshift_2)
txt_4 = Text(flatten(panel_2))
merge_8 = Merge(
    Data1="[start]central building height",
    Data2=txt,
    Data3="[end]central building height",
    Data4="[start]random seed number",
    Data5=txt_2,
    Data6="[end]random seed number",
    Data7="[start]input node coordination",
    Data8=txt_4,
    Data9="[end]input node coordination",
    Data10="[start]node reads difference",
    Data11=txt_3,
    Data12="[end]node reads difference")

# ---- group: data to export
panel_3 = Panel(merge_8)

# ----
panel_4 = Panel("C:\Users\RYAN\Dropbox (MIT)\01_Work\MAS\03_Winter 2016\Realtime Simulator\Data\Data4\160324_HV_R")
int_5 = Integer(int)
toggle_activate = BooleanToggle(True)
txt_5 = Text(int_5)
merge_9 = Merge(Data1=panel_4, Data2=txt_5, Data3=".txt")
join_4 = TextJoin(Text=merge_9)
panel_5 = Panel(join_4)

# ---- group: write txt file
vb = VBScript(filePath=panel_5, data=panel_3, append=False, activate=toggle_activate)  # -> out, A; inputs data: list
# ---------- vb: VB ----------
    'Code by Victor Leung @ www.dreamationworks.com
    If activate Then

      Dim i As Integer
      Dim aryText(4) As String

      aryText(0) = "Mary WriteLine"
      aryText(1) = "Had"
      aryText(2) = "Another"
      aryText(3) = "Little"
      aryText(4) = "One"

      ' the data is appended to the file. If file doesnt exist, a new file is created
      Dim objWriter As New System.IO.StreamWriter(filePath, append)

      For i = 0 To data.Count - 1
        objWriter.WriteLine(data(i))
      Next

      objWriter.Close()

    End If

    If clearFile Then
      Dim objWriter As New System.IO.StreamWriter(filePath, False)
      objWriter.Close()
    End If
# ---------- end vb ----------

# ==== cluster ExtractBrepTopOrBottom
brep = ClusterInput()
bool = ClusterInput()
brep_2 = Brep(brep)
bool_2 = Boolean(bool)
num = Number(bool_2)
debrep = DeconstructBrep(Brep=brep_2)  # -> Faces, Edges, Vertices
subtraction = Subtraction(A=num, B=0.5)
multiplication = Multiplication(A=subtraction, B=2)
Z = UnitZ(Factor=multiplication)
area = Area(Geometry=debrep.Faces)  # -> Area, Centroid
srf_cp = SurfaceClosestPoint(Point=area.Centroid, Surface=debrep.Faces)  # -> Point, UVPoint, Distance
evalsrf = EvaluateSurface(Surface=debrep.Faces, Point=srf_cp.UVPoint)  # -> Point, Normal, Frame
angle = Angle(VectorA=evalsrf.Normal, VectorB=Z)  # -> Angle, Reflex
equals = Equality(FirstNumber=angle.Angle, SecondNumber=0)  # -> Equality, Inequality
dispatch = Dispatch(List=debrep.Faces, DispatchPattern=equals.Equality)  # -> ListA, ListB
srf = Surface(dispatch.ListA)
srf_2 = ClusterOutput(srf)

# ==== cluster RemoveBrepTopOrBottom
brep = ClusterInput()
bool = ClusterInput()
brep_2 = Brep(brep)
bool_2 = Boolean(bool)
num = Number(bool_2)
debrep = DeconstructBrep(Brep=brep_2)  # -> Faces, Edges, Vertices
subtraction = Subtraction(A=num, B=0.5)
multiplication = Multiplication(A=subtraction, B=2)
Z = UnitZ(Factor=multiplication)
area = Area(Geometry=debrep.Faces)  # -> Area, Centroid
srf_cp = SurfaceClosestPoint(Point=area.Centroid, Surface=debrep.Faces)  # -> Point, UVPoint, Distance
evalsrf = EvaluateSurface(Surface=debrep.Faces, Point=srf_cp.UVPoint)  # -> Point, Normal, Frame
angle = Angle(VectorA=evalsrf.Normal, VectorB=Z)  # -> Angle, Reflex
equals = Equality(FirstNumber=angle.Angle, SecondNumber=0)  # -> Equality, Inequality
dispatch = Dispatch(List=debrep.Faces, DispatchPattern=equals.Inequality)  # -> ListA, ListB
srf = Surface(dispatch.ListA)
join = BrepJoin(Breps=srf)  # -> Breps, Closed
pshift = ShiftPaths(Data=join.Breps, Offset=-1)
brep_3 = Brep(pshift)
brep_4 = ClusterOutput(brep_3)
